# Grasshopper definition pipeline.gh (Grasshopper 1.0.8)
# plug-ins: Heteroptera, CORE.Grasshopper.Colibri, LunchBox, LadybugGrasshopper

# ----
# CSV for Different Scenarios
panel = Panel("""C:\Users\24031\Dropbox\Worcester building decarbonization and electrification\Journal publication\CHANDLER modeling\simulation scenarios\0428 new 2025 electrified scenario added\CSV Templates\CSV template 00.csv
C:\Users\24031\Dropbox\Worcester building decarbonization and electrification\Journal publication\CHANDLER modeling\simulation scenarios\0428 new 2025 electrified scenario added\CSV Templates\CSV template 01.csv
C:\Users\24031\Dropbox\Worcester building decarbonization and electrification\Journal publication\CHANDLER modeling\simulation scenarios\0428 new 2025 electrified scenario added\CSV Templates\CSV template 02.csv
C:\Users\24031\Dropbox\Worcester building decarbonization and electrification\Journal publication\CHANDLER modeling\simulation scenarios\0428 new 2025 electrified scenario added\CSV Templates\CSV template 03.csv
C:\Users\24031\Dropbox\Worcester building decarbonization and electrification\Journal publication\CHANDLER modeling\simulation scenarios\0428 new 2025 electrified scenario added\CSV Templates\CSV template 04.csv
C:\Users\24031\Dropbox\Worcester building decarbonization and electrification\Journal publication\CHANDLER modeling\simulation scenarios\0428 new 2025 electrified scenario added\CSV Templates\CSV template 05.csv
C:\Users\24031\Dropbox\Worcester building decarbonization and electrification\Journal publication\CHANDLER modeling\simulation scenarios\0428 new 2025 electrified scenario added\CSV Templates\CSV template 06.csv
C:\Users\24031\Dropbox\Worcester building decarbonization and electrification\Journal publication\CHANDLER modeling\simulation scenarios\0428 new 2025 electrified scenario added\CSV Templates\CSV template 07.csv
C:\Users\24031\Dropbox\Worcester building decarbonization and electrification\Journal publication\CHANDLER modeling\simulation scenarios\0428 new 2025 electrified scenario added\CSV Templates\CSV template 08.csv
C:\Users\24031\Dropbox\Worcester building decarbonization and electrification\Journal publication\CHANDLER modeling\simulation scenarios\0428 new 2025 electrified scenario added\CSV Templates\CSV template 09.csv
C:\Users\24031\Dropbox\Worcester building decarbonization and electrification\Journal publication\CHANDLER modeling\simulation scenarios\0428 new 2025 electrified scenario added\CSV Templates\CSV template 10.csv
C:\Users\24031\Dropbox\Worcester building decarbonization and electrification\Journal publication\CHANDLER modeling\simulation scenarios\0428 new 2025 electrified scenario added\CSV Templates\CSV template 11.csv
C:\Users\24031\Dropbox\Worcester building decarbonization and electrification\Journal publication\CHANDLER modeling\simulation scenarios\0428 new 2025 electrified scenario added\CSV Templates\CSV template 12.csv
C:\Users\24031\Dropbox\Worcester building decarbonization and electrification\Journal publication\CHANDLER modeling\simulation scenarios\0428 new 2025 electrified scenario added\CSV Templates\CSV template 13.csv""")
index = Slider(0, range=0..13)
item = ListItem(List=panel, Index=index, Wrap=True)

# ----
# CSV INPUT
path = FilePath(item)
file = ReadFile(File=path, PerLineParse=True)
csv = ReadCSV(CSVString=file, Delimiter=",")  # -> Headers, Values
panel_2 = Panel(csv.Headers)
replace = ReplaceMembers(Set=csv.Values)

panel_3 = Panel("16 Years and Over")
data = Data()

panel_4 = Panel("Footprint GeoJSON")
data_2 = Data()

panel_5 = Panel("Occupancy Number")
data_3 = Data()

panel_6 = Panel("Heating Setpoint")
data_4 = Data()

panel_7 = Panel("Cooling Setpoint")
data_5 = Data()

panel_8 = Panel("Building Index")
building_index = Data()

panel_9 = Panel("Worker Number")
data_6 = Data()

panel_10 = Panel("EV Percentage")
data_7 = Data()

panel_11 = Panel("Cooling Type")
data_8 = Data()

panel_12 = Panel("Weather File")
data_9 = Data()

panel_13 = Panel("Heating Fuel")
data_10 = Data()

panel_14 = Panel("Emission Year")
data_11 = Data()

panel_15 = Panel("Time to Work")
data_12 = Data()

panel_16 = Panel("Story Number")
data_13 = Data()

panel_17 = Panel("Heating Type")
data_14 = Data()

panel_18 = Panel("Floor")
data_15 = Data()

panel_19 = Panel("EXT-W")
data_16 = Data()

panel_20 = Panel("INT-W")
data_17 = Data()

panel_21 = Panel("Grade")
data_18 = Data()

data_19 = Data()
panel_22 = Panel("Roof")

data_20 = Data()
panel_23 = Panel("Rate")

data_21 = Data()
panel_24 = Panel("WWR")

# ----
# EV Percentage
data_22 = Data(data_7)

# ----
# Heating Fuel
# Heating Type
# AC type
# Building HVAC Data Input
data_23 = Data(data_14)
data_24 = Data(data_8)
data_25 = Data(data_10)
merge = Merge(Data1=simplify(graft(data_25)), Data2=simplify(graft(data_23)), Data3=simplify(graft(data_24)))
join = TextJoin(Text=merge, Join=",")  # -> flatten(Result)
panel_25 = Panel(join)

# ----
# WWR
# N
# E
# S
# W
data_26 = Data(data_21)

# ----
# Occupancy Number
data_27 = Data(data_3)

# ----
# Time to Work
# (Fixed) (r)
data_28 = Data(data_12)

# ----
# Story Number
data_29 = Data(data_13)

# ----
# 16 Years and Over
data_30 = Data(data)

# ----
# Worker Number
data_31 = Data(data_6)

# ----
# Grade
data_32 = Data(data_18)

toggle = BooleanToggle(True)

# ----
# Footprint GeoJSON
path_2 = FilePath(data_2)

# ----
# Heating Setpoint
data_33 = Data(data_4)

# ----
# Cooling Setpoint
data_34 = Data(data_5)

# ----
# Rate
data_35 = Data(data_20)

fromgeojson = DFModelFromGeoJSON(geojson=path_2, other_geo=toggle, import=toggle)  # -> report, model, other_geo, location, point; plug-in component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

# ----
# Employ Rate (1-A)
division = Division(A=data_31, B=data_30)
expression = Expression(x=division, Expression="Format(\"{0:0.00}\", x)")

vizfloors = DFVisualizeFloors(df_objs=flatten(fromgeojson.model))  # -> geo; plug-in component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

# ----
# Replacing HVAC with HP
list = ValueList({"25%": 0.25, "50%": 0.5, "75%": 0.75, "100%": 1}, selected="25%")
lng = ListLength(List=vizfloors)
multiplication = Multiplication(A=lng, B=list)
random = Random(Range=lng, Number=multiplication, Seed=2)
replace_2 = ReplaceItems(List=panel_25, Item="Electric,Electric,Heat Pump", Indices=random, Wrap=False)

# ----
# EXT-W
# Roof
# INT-W
# Floor
# Building Data
data_36 = Data(data_17)
data_37 = Data(data_16)
data_38 = Data(data_15)
data_39 = Data(data_19)

# ----
# Stories
int = Integer(data_29)
lng_2 = ListLength(List=int)
equals = Equality(FirstNumber=int, SecondNumber="0")  # -> Equality, Inequality
series = Series(Start="0", Step=1, Count=lng_2)
dispatch = Dispatch(List=series, DispatchPattern=equals.Inequality)  # -> ListA, ListB
dispatch_2 = Dispatch(List=int, DispatchPattern=equals.Inequality)  # -> ListA, ListB
lng_3 = ListLength(List=dispatch_2.ListB)
dup = DuplicateData(Data="1", Number=lng_3, Order=True)
merge_2 = Merge(Data1=dispatch.ListA, Data2=dispatch.ListB)  # -> flatten(Result)
merge_3 = Merge(Data1=dispatch_2.ListA, Data2=dup)  # -> flatten(Result)
sort = SortList(Keys=merge_2, ValuesA=merge_3)  # -> Keys, graft(ValuesA)

# ----
# setpoint from DOE prototype
panel_26 = Panel("Temperature")
constantschedule = HBConstantSchedule(values=data_33, type_limit=panel_26)  # -> report, schedule, idf_text; plug-in component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
constantschedule_2 = HBConstantSchedule(values=data_34, type_limit=panel_26)  # -> report, schedule, idf_text; plug-in component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
setpoint = HBSetpoint(heating_sch=constantschedule.schedule, cooling_sch=constantschedule_2.schedule)  # -> setpoint; plug-in component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

# ----
# Data Set
floor = Panel("""0
Carpet
Ceramic Tile
Hardwood
Softwood
Typical
Vinyl Tile""")
ext_w = Panel("""0
Aluminum/Vinyl
Asphalt/Asbest
Brick/Stone
Clapboard
Concrete Block
Metal
Stucco
Veneer Brk/Stn
Wood Shingle""")
roof = Panel("""0
Asbestos Shing
Asph/Fbgl/Comp
Asphalt
Clay Tile
Concrete Tile
Enam Mtl Shing
Metal
Metal/Tin
Rolled Comp
Rubber Roof
Rubber Roofing
Slate
T&G Comm
T&G Resden
Tar & Gravel
Typical
Wood Shingle""")
int_w = Panel("""0
Cust/Wd/Panel
Dry Wall
Drywall/Shtrk
Minim/Masonry
Paneling
Plaster
Plasters
Plywood Pnl
Typical""")

# ----
# HVAC Selection
heating_set = Panel("""0
Typical
Water Fh
Forced Air
Steam
Electric
Heat Pump""")
cooling_set = Panel("""0
Wall Units
Central
Heat Pump""")
heating_fuel_set = Panel("""0
Gas
Oil
Electric
Propane""")
crossref = CrossReference(ListA=heating_fuel_set, ListB=heating_set, ListC=cooling_set, CrossMode=1)  # -> graft(ListA), graft(ListB), graft(ListC)
merge_4 = Merge(Data1=crossref.ListA, Data2=crossref.ListB, Data3=crossref.ListC)
hvac_selection = Panel("""HeatCool:BoilerBaseboard
HeatCool:BoilerBaseboard
HeatCool:BoilerBaseboard
HeatCool:ElectricBaseboard
HeatCool:BoilerBaseboard
HeatCool:BoilerBaseboard
HeatCool:BoilerBaseboard
HeatCool:BoilerBaseboard
HeatCool:ElectricBaseboard
HeatCool:BoilerBaseboard
HeatCool:BoilerBaseboard
HeatCool:BoilerBaseboard
HeatCool:BoilerBaseboard
HeatCool:BoilerBaseboard
HeatCool:BoilerBaseboard
HeatCool:ResidentialFurnace
HeatCool:ResidentialFurnace
HeatCool:ResidentialFurnace
AllAir:Furnace_Electric
HeatCool:ResidentialFurnace
HeatCool:BoilerBaseboard
HeatCool:BoilerBaseboard
HeatCool:BoilerBaseboard
HeatCool:BoilerBaseboard
HeatCool:BoilerBaseboard
HeatCool:ElectricBaseboard
HeatCool:BoilerBaseboard
HeatCool:BoilerBaseboard
HeatCool:ElectricBaseboard
HeatCool:BoilerBaseboard
HeatCool:ResidentialHPNoCool
HeatCool:ResidentialHPNoCool
HeatCool:ResidentialHPNoCool
HeatCool:ResidentialHPNoCool
HeatCool:ResidentialHPNoCool
HeatCool:WindowAC
HeatCool:WindowAC
HeatCool:WindowAC
HeatCool:WindowAC
HeatCool:WindowAC
HeatCool:WindowAC_BoilerBaseboard
HeatCool:WindowAC_BoilerBaseboard
HeatCool:WindowAC_BoilerBaseboard
HeatCool:WindowAC_ElectricBaseboard
HeatCool:WindowAC_BoilerBaseboard
HeatCool:WindowAC_BoilerBaseboard
HeatCool:WindowAC_BoilerBaseboard
HeatCool:WindowAC_BoilerBaseboard
HeatCool:WindowAC_BoilerBaseboard
HeatCool:WindowAC_BoilerBaseboard
HeatCool:WindowAC_Furnace
HeatCool:WindowAC_Furnace
HeatCool:WindowAC_Furnace
HeatCool:WindowAC_Furnace
HeatCool:WindowAC_Furnace
HeatCool:WindowAC_BoilerBaseboard
HeatCool:WindowAC_BoilerBaseboard
HeatCool:WindowAC_BoilerBaseboard
HeatCool:WindowAC_BoilerBaseboard
HeatCool:WindowAC_BoilerBaseboard
HeatCool:ResidentialAC_ElectricBaseboard
HeatCool:ResidentialAC_BoilerBaseboard
HeatCool:ResidentialAC_BoilerBaseboard
HeatCool:WindowAC_ElectricBaseboard
HeatCool:ResidentialAC_BoilerBaseboard
HeatCool:ResidentialHP
HeatCool:ResidentialHP
HeatCool:ResidentialHP
HeatCool:WindowAC_ASHPBaseboard
HeatCool:ResidentialHP
HeatCool:ResidentialAC
HeatCool:ResidentialAC
HeatCool:ResidentialAC
HeatCool:ResidentialAC
HeatCool:ResidentialAC
HeatCool:ResidentialAC_BoilerBaseboard
HeatCool:ResidentialAC_BoilerBaseboard
HeatCool:ResidentialAC_BoilerBaseboard
HeatCool:ResidentialAC_ElectricBaseboard
HeatCool:ResidentialAC_BoilerBaseboard
HeatCool:ResidentialAC_BoilerBaseboard
HeatCool:ResidentialAC_BoilerBaseboard
HeatCool:ResidentialAC_BoilerBaseboard
HeatCool:ResidentialAC_BoilerBaseboard
HeatCool:ResidentialAC_BoilerBaseboard
HeatCool:ResidentialAC_ResidentialFurnace
HeatCool:ResidentialAC_ResidentialFurnace
HeatCool:ResidentialAC_ResidentialFurnace
HeatCool:ResidentialAC_ResidentialFurnace
HeatCool:ResidentialAC_ResidentialFurnace
HeatCool:ResidentialAC_BoilerBaseboard
HeatCool:ResidentialAC_BoilerBaseboard
HeatCool:ResidentialAC_BoilerBaseboard
HeatCool:ResidentialAC_BoilerBaseboard
HeatCool:ResidentialAC_BoilerBaseboard
HeatCool:ResidentialAC_ElectricBaseboard
HeatCool:ResidentialAC_BoilerBaseboard
HeatCool:ResidentialAC_BoilerBaseboard
HeatCool:ResidentialAC_ElectricBaseboard
HeatCool:ResidentialAC_BoilerBaseboard
HeatCool:ResidentialHP
HeatCool:ResidentialHP
HeatCool:ResidentialHP
HeatCool:ResidentialAC_ASHPBaseboard
HeatCool:ResidentialHP
HeatCool:ResidentialHP
HeatCool:ResidentialHP
HeatCool:ResidentialHP
HeatCool:WindowAC
HeatCool:ResidentialHP
HeatCool:WindowAC_BoilerBaseboard
HeatCool:WindowAC_BoilerBaseboard
HeatCool:WindowAC_BoilerBaseboard
HeatCool:ResidentialHP
HeatCool:WindowAC_BoilerBaseboard
HeatCool:WindowAC_BoilerBaseboard
HeatCool:WindowAC_BoilerBaseboard
HeatCool:WindowAC_BoilerBaseboard
HeatCool:WindowAC_BoilerBaseboard
HeatCool:WindowAC_BoilerBaseboard
HeatCool:ResidentialAC_ResidentialFurnace
HeatCool:ResidentialAC_ResidentialFurnace
HeatCool:ResidentialAC_ResidentialFurnace
HeatCool:ResidentialAC_ResidentialFurnace
HeatCool:ResidentialAC_ResidentialFurnace
HeatCool:WindowAC_BoilerBaseboard
HeatCool:WindowAC_BoilerBaseboard
HeatCool:WindowAC_BoilerBaseboard
HeatCool:WindowAC_BoilerBaseboard
HeatCool:WindowAC_BoilerBaseboard
HeatCool:ResidentialHP
HeatCool:ResidentialHP
HeatCool:ResidentialHP
HeatCool:ResidentialHP
HeatCool:ResidentialHP
HeatCool:ResidentialHP
HeatCool:ResidentialHP
HeatCool:ResidentialHP
HeatCool:ResidentialHP
HeatCool:ResidentialHP""")
join_2 = TextJoin(Text=merge_4, Join=",")  # -> flatten(Result)
panel_27 = Panel(join_2)

# ----
# Construction Selection
roof_2 = Panel("""Generic Roof
Typical Built Up Roof
Typical Built Up Roof
Typical Built Up Roof
Typical Built Up Roof
Typical Built Up Roof
Typical Insulated Metal Building Roof
Typical Insulated Metal Building Roof
Typical Insulated Metal Building Roof
Typical IEAD Roof
Typical IEAD Roof
Typical IEAD Roof
Typical IEAD Roof
Typical Built Up Roof
Typical Built Up Roof
Typical Built Up Roof
Typical Built Up Roof
Typical Built Up Roof""")
floor_2 = Panel("""Generic Interior Floor
Typical Carpeted 4in Slab Floor
Generic Interior Floor
Typical Wood Joist Attic Floor
Typical Wood Joist Attic Floor
Typical Interior Floor
Typical Interior Floor""")
int_w_2 = Panel("""Generic Interior Wall
Typical Interior Wall
Typical Interior Wall
Typical Interior Wall
Typical Interior Wall
Typical Interior Partition
Typical Interior Partition
Typical Interior Partition
Typical Interior Partition
Typical Interior Wall""")
ext_w_2 = Panel("""Generic Exterior Wall
Typical Insulated Steel Framed Exterior Wall
Generic Exterior Wall
Typical Insulated Exterior Mass Wall
Typical Insulated Wood Framed Exterior Wall
Typical Insulated Exterior Mass Wall
Typical Insulated Steel Framed Exterior Wall
Generic Exterior Wall
Typical Insulated Exterior Mass Wall
Typical Insulated Wood Framed Exterior Wall""")

# ----
# EX-W
# Roof
# IN-W
# Floor
panel_28 = Panel("5A")
constrsetclimate = HBConstructionSetByClimate(climate_zone=panel_28)  # -> constr_set; plug-in component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
mindex = MemberIndex(Set=ext_w, Member=data_37)  # -> Index, Count
mindex_2 = MemberIndex(Set=roof, Member=data_39)  # -> Index, Count
mindex_3 = MemberIndex(Set=int_w, Member=data_36)  # -> Index, Count
mindex_4 = MemberIndex(Set=floor, Member=data_38)  # -> Index, Count
item_2 = ListItem(List=ext_w_2, Index=mindex.Index, Wrap=True)
item_3 = ListItem(List=roof_2, Index=mindex_2.Index, Wrap=True)
item_4 = ListItem(List=int_w_2, Index=mindex_3.Index, Wrap=True)
item_5 = ListItem(List=floor_2, Index=mindex_4.Index, Wrap=True)

# ----
# HVAC Selection
heating_set_2 = Panel("""Null
Typical
Water Fh
Forced Air
Steam
Electric
Heat Pump""")
cooling_set_2 = Panel("""Null
Wall Units
Central
Heat Pump""")
heating_fuel_set_2 = Panel("""Null
Gas
Oil
Electric
Propane""")
crossref_2 = CrossReference(ListA=heating_fuel_set_2, ListB=heating_set_2, ListC=cooling_set_2, CrossMode=1)  # -> graft(ListA), graft(ListB), graft(ListC)
merge_5 = Merge(Data1=crossref_2.ListA, Data2=crossref_2.ListB, Data3=crossref_2.ListC)
hvac_selection_2 = Panel("""Null: 
Null: 
Null: 
Null: 
Null: 
HeatCool:BoilerBaseboard
HeatCool:BoilerBaseboard
HeatCool:BoilerBaseboard
HeatCool:ElectricBaseboard
HeatCool:BoilerBaseboard
HeatCool:BoilerBaseboard
HeatCool:BoilerBaseboard
HeatCool:BoilerBaseboard
HeatCool:BoilerBaseboard
HeatCool:BoilerBaseboard
HeatCool:ResidentialFurnace
HeatCool:ResidentialFurnace
HeatCool:ResidentialFurnace
AllAir:Furnace_Electric
HeatCool:ResidentialFurnace
HeatCool:BoilerBaseboard
HeatCool:BoilerBaseboard
HeatCool:BoilerBaseboard
HeatCool:BoilerBaseboard
HeatCool:BoilerBaseboard
Null: 
Null: 
Null: 
HeatCool:ElectricBaseboard
Null: 
Null: 
Null: 
Null: 
HeatCool:ResidentialHPNoCool
Null: 
HeatCool:WindowAC
HeatCool:WindowAC
HeatCool:WindowAC
HeatCool:WindowAC
HeatCool:WindowAC
HeatCool:WindowAC_BoilerBaseboard
HeatCool:WindowAC_BoilerBaseboard
HeatCool:WindowAC_BoilerBaseboard
HeatCool:WindowAC_ElectricBaseboard
HeatCool:WindowAC_BoilerBaseboard
HeatCool:WindowAC_BoilerBaseboard
HeatCool:WindowAC_BoilerBaseboard
HeatCool:WindowAC_BoilerBaseboard
HeatCool:WindowAC_BoilerBaseboard
HeatCool:WindowAC_BoilerBaseboard
HeatCool:WindowAC_Furnace
HeatCool:WindowAC_Furnace
HeatCool:WindowAC_Furnace
HeatCool:WindowAC_Furnace
HeatCool:WindowAC_Furnace
HeatCool:WindowAC_BoilerBaseboard
HeatCool:WindowAC_BoilerBaseboard
HeatCool:WindowAC_BoilerBaseboard
HeatCool:WindowAC_BoilerBaseboard
HeatCool:WindowAC_BoilerBaseboard
Null: 
Null: 
Null: 
HeatCool:WindowAC_ElectricBaseboard
Null: 
Null: 
Null: 
Null: 
HeatCool:WindowAC_ASHPBaseboard
Null: 
HeatCool:ResidentialAC
HeatCool:ResidentialAC
HeatCool:ResidentialAC
HeatCool:ResidentialAC
HeatCool:ResidentialAC
HeatCool:ResidentialAC_BoilerBaseboard
HeatCool:ResidentialAC_BoilerBaseboard
HeatCool:ResidentialAC_BoilerBaseboard
HeatCool:ResidentialAC_ElectricBaseboard
HeatCool:ResidentialAC_BoilerBaseboard
HeatCool:ResidentialAC_BoilerBaseboard
HeatCool:ResidentialAC_BoilerBaseboard
HeatCool:ResidentialAC_BoilerBaseboard
HeatCool:ResidentialAC_BoilerBaseboard
HeatCool:ResidentialAC_BoilerBaseboard
HeatCool:ResidentialAC_ResidentialFurnace
HeatCool:ResidentialAC_ResidentialFurnace
HeatCool:ResidentialAC_ResidentialFurnace
HeatCool:ResidentialAC_ResidentialFurnace
HeatCool:ResidentialAC_ResidentialFurnace
HeatCool:ResidentialAC_BoilerBaseboard
HeatCool:ResidentialAC_BoilerBaseboard
HeatCool:ResidentialAC_BoilerBaseboard
HeatCool:ResidentialAC_BoilerBaseboard
HeatCool:ResidentialAC_BoilerBaseboard
Null: 
Null: 
Null: 
HeatCool:ResidentialAC_ElectricBaseboard
Null: 
Null: 
Null: 
Null: 
HeatCool:ResidentialAC_ASHPBaseboard
Null: 
HeatCool:ResidentialHP
HeatCool:ResidentialHP
HeatCool:ResidentialHP
HeatCool:WindowAC
HeatCool:ResidentialHP
HeatCool:WindowAC_BoilerBaseboard
HeatCool:WindowAC_BoilerBaseboard
HeatCool:WindowAC_BoilerBaseboard
HeatCool:ResidentialHP
HeatCool:WindowAC_BoilerBaseboard
HeatCool:WindowAC_BoilerBaseboard
HeatCool:WindowAC_BoilerBaseboard
HeatCool:WindowAC_BoilerBaseboard
HeatCool:WindowAC_BoilerBaseboard
HeatCool:WindowAC_BoilerBaseboard
HeatCool:ResidentialAC_ResidentialFurnace
HeatCool:ResidentialAC_ResidentialFurnace
HeatCool:ResidentialAC_ResidentialFurnace
HeatCool:ResidentialAC_ResidentialFurnace
HeatCool:ResidentialAC_ResidentialFurnace
HeatCool:WindowAC_BoilerBaseboard
HeatCool:WindowAC_BoilerBaseboard
HeatCool:WindowAC_BoilerBaseboard
HeatCool:WindowAC_BoilerBaseboard
HeatCool:WindowAC_BoilerBaseboard
Null: 
Null: 
Null: 
HeatCool:ResidentialHP
Null: 
Null: 
Null: 
Null: 
HeatCool:ResidentialHP
Null: """)
join_3 = TextJoin(Text=merge_5, Join=",")  # -> flatten(Result)
panel_29 = Panel(join_3)

# ----
# Leakyness
panel_30 = Panel("""0
Poor
Poor To Fair
Fair
Fair To Avg
Average
Avg To Good
Good
Good To Vg
Very Good
Vg To Exc
Excellent""")
mindex_5 = MemberIndex(Set=panel_30, Member=data_32)  # -> Index, Count
panel_31 = Panel("""0.0003
0.0001
0.00015
0.0002
0.00025
0.0003
0.00035
0.0004
0.00045
0.0005
0.00055
0.0006""")
item_6 = ListItem(List=panel_31, Index=mindex_5.Index, Wrap=True)

# ----
# for index 7 and 18 when (2-r)>1
panel_32 = Panel("1")

# ----
# Construction
interiorsubset = HBInteriorConstructionSubset(interior_wall=item_4)  # -> interior_set; plug-in component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
subfacesubset = HBSubfaceSubset()  # -> subface_set; plug-in component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
exteriorsubset = HBExteriorConstructionSubset(exterior_wall=item_2, exterior_roof=item_3)  # -> exterior_set; plug-in component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
groundsubset = HBGroundConstructionSubset(ground_floor=item_5)  # -> ground_set; plug-in component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
constructionset = HBConstructionSet(
    base_constr_set=constrsetclimate,
    exterior_subset=exteriorsubset,
    ground_subset=groundsubset,
    interior_subset=interiorsubset,
    subface_subset=subfacesubset)  # -> constr_set; plug-in component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

panel_33 = Panel("Typical Public")

file_2 = ReadFile(File="Z:\simulation\CHANDLER_before_0428\filtered_row.csv", PerLineParse=True)
csv_2 = ReadCSV(CSVString=file_2, Delimiter=",")  # -> Headers, Values
panel_34 = Panel(csv_2.Headers)
panel_35 = Panel(csv_2.Values)
cset = CreateSet(List=panel_35)  # -> Set, Map
lng_4 = ListLength(List=cset.Set)
series_2 = Series(Start=0, Step=1, Count=lng_4)
extremes = MinMax(Number=series_2)  # -> Minimum, Maximum
gradient = Gradient(
    LowerLimit=extremes.Minimum,
    UpperLimit=extremes.Maximum,
    Parameter=cset.Map,
    stops=[0: RGB(243, 57, 0), 0.1: RGB(236, 27, 60), 0.2: RGB(210, 0, 118), 0.3: RGB(103, 0, 120), 0.4: RGB(39, 72, 161), 0.5: RGB(1, 192, 229), 0.6: RGB(18, 178, 90), 0.7: RGB(79, 186, 8), 0.8: RGB(220, 237, 32), 0.9: RGB(247, 159, 20), 1: RGB(243, 57, 0)])
legendpar = LBLegendParameters(seg_count=lng_4, colors=gradient)  # -> leg_par; plug-in component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
legend2d = LBLegend2DParameters(seg_height="2%")  # -> leg_par2d; plug-in component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
preview = CustomPreview(Geometry=vizfloors, Material=gradient)
createlegend = LBCreateLegend(values=series_2, legend_par=legendpar, leg_par2d=legend2d)  # -> mesh, title_obj, label_objs, label_text, colors; plug-in component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

# ----
# Road Network
toggle_2 = BooleanToggle(True)
fromgeojson_2 = DFModelFromGeoJSON(geojson=path_2, all_to_bldg=toggle_2, import=toggle_2)  # -> report, model, other_geo, location, point; plug-in component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
vizfloors_2 = DFVisualizeFloors(df_objs=flatten(fromgeojson_2.model))  # -> geo; plug-in component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
item_7 = ListItem(List=vizfloors_2, Index=expr("-1", 0), Wrap=True)
geo = Geometry(fromgeojson.other_geo)
substation = DFSubstation(geo=item_7)  # -> substation; plug-in component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
topoly = CurveToPolyline(Curve=geo, ToleranceDistance=0, ToleranceAngle=0)  # -> Polyline, Segments
roads = DFRoadNetwork(substation=substation, road_geo=flatten(topoly.Polyline))  # -> report, network; plug-in component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

split = TextSplit(Text=item, Separators=".")
item_8 = ListItem(List=split, Index=0, Wrap=True)
split_2 = TextSplit(Text=item_8, Separators=" ")
item_9 = ListItem(List=split_2, Index=-1, Wrap=True)

list_2 = ValueList({"Original Scenario": 0, "Electrified Scenario": 1, "Percentage Electrified": 2}, selected="Original Scenario")
panel_36 = Panel("""0
1
0
1
0
1
0
1
0
1
0
1
0
1""")
item_10 = ListItem(List=panel_36, Index=index, Wrap=True)

panel_37 = Panel("F:\IBPSA\2050_ANL_SSP5_original_95_2050_RNM")  # disabled
panel_38 = Panel("""\0to24
\25to49
\50to74
\75to99
\100to124
\125to149
\150to174
\175to199
\200to209""")  # disabled
lng_5 = ListLength(List=panel_38)  # disabled
dup_2 = DuplicateData(Data=panel_37, Number=lng_5, Order=True)  # -> simplify(graft(Data)); disabled
data_40 = Data(simplify(graft(panel_38)))  # disabled
join_4 = TextJoin(Text=[dup_2, data_40])  # -> flatten(Result); disabled
panel_39 = Panel(join_4)  # disabled

# ----
# Current Weather File
panel_40 = Panel("https://energyplus-weather.s3.amazonaws.com/north_and_central_america_wmo_region_4/USA/MA/USA_MA_Worcester.Rgnl.AP.725095_TMY3/USA_MA_Worcester.Rgnl.AP.725095_TMY3.zip")
downloadepw = LBDownloadWeather(weather_URL=panel_40)  # -> epw_file, stat_file, ddy_file; plug-in component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
importloc = LBImportLocation(epw_file=downloadepw.epw_file)  # -> location; plug-in component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

# ----
# Weather File
panel_41 = Panel(data_9)
path_3 = FilePath(panel_41)

# ----
# EUI
eui = HBEndUseIntensity()  # -> eui, eui_end_use, end_uses, gross_floor; plug-in component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
panel_42 = Panel(eui.eui)
panel_43 = Panel(eui.eui_end_use)
panel_44 = Panel(eui.end_uses)
roomenergyresult = HBReadRoomEnergyResult()  # -> cooling, heating, lighting, electric_equip, gas_equip, process, hot_water, fan_electric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; plug-in component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
panel_45 = Panel("""cooling
heating
lighting
electric_equip
hot_water
pump_electric""")
entwine = Entwine(
    Branch00=flatten(roomenergyresult.cooling),
    Branch01=flatten(roomenergyresult.heating),
    Branch02=flatten(roomenergyresult.lighting),
    Branch03=flatten(roomenergyresult.electric_equip),
    Branch04=flatten(roomenergyresult.fan_electric),
    Branch05=flatten(roomenergyresult.pump_electric),
    FlattenInputs=True)
massarithop = LBMassArithmeticOperation(data=entwine, type=graft(panel_45))  # -> data; plug-in component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
normalize = LBAreaNormalize(data=massarithop, area=eui.gross_floor)  # -> data; plug-in component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
monthlychart = LBMonthlyChart(data=flatten(normalize), stack=Toggle(True))  # -> report, data_mesh, data_lines, col_lines, legend, borders, labels, y_title, title, vis_set; plug-in component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

# ----
# Grid Load
falsestart = LBFalseStartToggle(False)
falsestart_2 = LBFalseStartToggle(False)
newtworkattr = DFNetworkAttributes({"Display Name": "display_name", "Simulation Name (Identifier)": "identifier", "Nominal Voltage": "nominal_voltage", "Phase Count": "phase_count", "Wire Count": "power_line.wire_count", "Wire Phases": "power_line.phases"}, selected="Nominal Voltage")
runrnm = DFRunRNM(run=falsestart)  # -> report, network, dss_results; plug-in component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
runopendss = DFRunOpenDSS(run=falsestart_2)  # -> report, buildings, connectors, transformers; plug-in component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
colornetattr = DFColorNetworkAttributes(network=runrnm.network, attribute=newtworkattr)  # -> vis_geo, legend, values, colors; plug-in component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
opendssresult = DFReadOpenDSSResult(dss_csv=runopendss.buildings)  # -> factors, condition; plug-in component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
hourlyplot = LBHourlyPlot(data=opendssresult.factors, x_dim="4")  # -> report, mesh, legend, borders, labels, title, vis_set; plug-in component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

# ----
# CARBON
# RUN SIMULATION
panel_46 = Panel("Future_Hourly_Electricity_Emissions")
importloc_2 = LBImportLocation()  # -> location; plug-in component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
cei = HBCarbonEmissionIntensity(loc_kgMWh=importloc_2)  # -> cei, cei_end_use, end_uses, gross_floor; plug-in component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
customresult = HBReadCustomResult(output_names=panel_46)  # -> results; plug-in component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
panel_47 = Panel(cei.cei)
panel_48 = Panel(cei.cei_end_use)
massarithop_2 = LBMassArithmeticOperation(data=flatten(customresult))  # -> data; plug-in component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
panel_49 = Panel(cei.end_uses)
legendpar_2 = LBLegendParameters(num_decimals="5")  # -> leg_par; plug-in component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
hourlyplot_2 = LBHourlyPlot(data=massarithop_2, legend_par=legendpar_2)  # -> report, mesh, legend, borders, labels, title, vis_set; plug-in component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

toggle_3 = BooleanToggle(True)
simoutput = HBSimulationOutput(zone_energy_use=toggle_3, system_energy_use=toggle_3, gains_and_losses=toggle_3, comfort_metrics=toggle_3)  # -> report, sim_output; plug-in component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
customoutput = HBCustomSimulationOutput(base_sim_output=simoutput.sim_output, output_names="Exterior Equipment Electricity Energy")  # -> report, sim_output; plug-in component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
simpar = HBSimulationParameter(output=customoutput.sim_output, timestep="1")  # -> sim_par; plug-in component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

merge_6 = Merge(Data1="H:\simulation\CHANDLER", Data2=item_9)  # -> flatten(Result)
join_5 = TextJoin(Text=merge_6, Join="\")

panel_50 = Panel("""H:\simulation\CHANDLER\baseline\baseline.geojson
H:\simulation\CHANDLER\01\01.geojson
H:\simulation\CHANDLER\02\02.geojson
H:\simulation\CHANDLER\03\03.geojson
H:\simulation\CHANDLER\04\04.geojson
H:\simulation\CHANDLER\05\05.geojson
H:\simulation\CHANDLER\06\06.geojson
H:\simulation\CHANDLER\07\07.geojson
H:\simulation\CHANDLER\08\08.geojson
H:\simulation\CHANDLER\09\09.geojson
H:\simulation\CHANDLER\10\10.geojson
H:\simulation\CHANDLER\11\11.geojson
H:\simulation\CHANDLER\12\12.geojson
H:\simulation\CHANDLER\13\13.geojson""")
item_11 = ListItem(List=panel_50, Index=index, Wrap=True)

# ----
# EV Charging
panel_51 = Panel("C:\URBANopt-cli-0.14.0\gems\ruby\2.7.0\gems\openstudio-common-measures-gem-0.9.0\lib\measures\add_ev_load")

# ----
# Occupancy Schedule
num = Number(data_35)
multiplication_2 = Multiplication(A=num, B="1000")
subtraction = Subtraction(A="1", B=expression)
num_2 = Number(subtraction)
panel_52 = Panel("Occupancy Schedule")
lng_6 = ListLength(List=vizfloors)
series_3 = Series(Start=0, Step=1, Count=lng_6)  # -> graft(Series)
genes = GenePool(Decimals=2, Maximum=1, Minimum=0, Value=[1, 1, 1, 1, 1, 1, 1, 1, 1, 1, 1, 1, 1, 1, 1, 1, 1, 1, 1, 1, 1, 1, 1, 1])
genes_2 = GenePool(Decimals=2, Maximum=1, Minimum=0, Value=[1, 1, 1, 1, 1, 1, 1, 1, 1, 1, 1, 1, 1, 1, 1, 1, 1, 1, 1, 1, 1, 1, 1, 1])

# ----
# pickup time to work according to the rate
number_slider = Slider(41, range=0..100)
dup_3 = DuplicateData(Data=graft(data_28), Number=graft(multiplication_2), Order=True)  # -> flatten(Data)
lng_7 = ListLength(List=dup_3)
lng_8 = ListLength(List=vizfloors)
random_2 = Random(Range=lng_7, Number=lng_8, Seed=number_slider, Integers=True)

# ----
# no
# (2-r)>1
# yes
# (2-r)<1
# check if they use
# more than one hour
# on transportation
item_12 = ListItem(List=dup_3, Index=random_2, Wrap=True)
subtraction_2 = Subtraction(A="2", B=item_12)
larger = LargerThan(FirstNumber=subtraction_2, SecondNumber="1")  # -> LargerThan, OrEqualTo
dispatch_3 = Dispatch(List=subtraction_2, DispatchPattern=larger.OrEqualTo)  # -> ListA, ListB

# ----
# for index 8 and 17 when (2-r)>1
index_2 = ItemIndex(List=subtraction_2, Item=dispatch_3.ListA)
item_13 = ListItem(List=item_12, Index=index_2, Wrap=True)
eval = Evaluate(F="1-(1-A)*r", r=item_13, A=num_2)

# ----
# for index 7 and 18 when (2-r)<1
index_3 = ItemIndex(List=subtraction_2, Item=dispatch_3.ListB)
item_14 = ListItem(List=item_12, Index=index_3, Wrap=True)
eval_2 = Evaluate(F="1-(1-A)*(r-1)", r=item_14, A=num_2)
clean = CleanTree(RemoveNulls=True, RemoveInvalid=True, RemoveEmpty=False, Tree=eval_2)

# ----
# for index 8 and 17 when (2-r)<1
panel_53 = Panel(num_2)

# ----
# index of households working at home or not
panel_54 = Panel("0")
equals_2 = Equality(FirstNumber=item_12, NotGoingToWork=panel_54)  # -> Equality, Inequality
mindex_6 = MemberIndex(Set=equals_2.Equality, Member=Toggle(True))  # -> Index, Count
mindex_7 = MemberIndex(Set=equals_2.Equality, Member=Toggle(False))  # -> Index, Count

# ----
# index of households working at home or not
panel_55 = Panel("0")
equals_3 = Equality(FirstNumber=item_12, NotGoingToWork=panel_55)  # -> Equality, Inequality
mindex_8 = MemberIndex(Set=equals_3.Equality, Member=Toggle(True))  # -> Index, Count
mindex_9 = MemberIndex(Set=equals_3.Equality, Member=Toggle(False))  # -> Index, Count

# ----
# Charging Behavior
list_3 = ValueList({"non-WFH charging behavior": "Business as usual", "WFH charging behavior": "Free Workplace Charging at Project Site", "charge mostly at work": "Free Workplace Charging Across Metro Area"}, selected="WFH charging behavior")
list_4 = ValueList({"non-WFH charging behavior": "Business as usual", "WFH charging behavior": "Free Workplace Charging at Project Site", "charge mostly at work": "Free Workplace Charging Across Metro Area"}, selected="non-WFH charging behavior")
lng_9 = ListLength(List=vizfloors)
series_4 = Series(Start=0, Step=1, Count=lng_9)
replace_3 = ReplaceItems(List=series_4, Item=list_3, Indices=mindex_6.Index, Wrap=False)
replace_4 = ReplaceItems(List=replace_3, Item=list_4, Indices=mindex_7.Index, Wrap=False)

# ----
# Charging Station type
lng_10 = ListLength(List=vizfloors)
series_5 = Series(Start=0, Step=1, Count=lng_10)
replace_5 = ReplaceItems(List=series_5, Item="Typical Home", Indices=mindex_8.Index, Wrap=False)
replace_6 = ReplaceItems(List=replace_5, Item="Typical Work", Indices=mindex_9.Index, Wrap=False)

# ----
# Default Occupancy Schedule
panel_56 = Panel("1")
num_3 = Number(num_2)
dup_4 = DuplicateData(Data=panel_56, Number="24", Order=True)
series_6 = Series(Start="9", Step=1, Count="8")
replace_7 = ReplaceItems(List=dup_4, Item=num_3, Indices=series_6, Wrap=False)

add_ev_load = Add_EV_Load(measure_path=panel_51, charge_behavior=replace_4, chg_station_type=replace_6, ev_percent=data_22)  # -> report, flatten(mapper); plug-in component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

# ----
# Program
bldgprograms = HBBuildingPrograms({"LargeOffice", "MediumOffice", "SmallOffice", "MidriseApartment", "HighriseApartment", "Retail", "StripMall", "PrimarySchool", "SecondarySchool", "SmallHotel", "LargeHotel", "Hospital", "Outpatient", "Laboratory", "Warehouse", "SuperMarket", "FullServiceRestaurant", "QuickServiceRestaurant", "Courthouse", "College", "LargeDataCenterHighITE", "LargeDataCenterLowITE", "SmallDataCenterHighITE", "SmallDataCenterLowITE"}, selected="MidriseApartment")
searchprog = HBSearchPrograms(bldg_prog=bldgprograms, keywords="Apartment")  # -> room_prog; plug-in component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
area = Area(Geometry=vizfloors)  # -> Area, Centroid
division_2 = Division(A=graft(data_27), B=graft(area.Area))
infiltration = HBInfiltration(flow_per_ext_area=item_6)  # -> infil; plug-in component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

lng_11 = ListLength(List=subtraction_2)
series_7 = Series(Start="0", Step=1, Count=lng_11)
dispatch_4 = Dispatch(List=series_7, DispatchPattern=larger.OrEqualTo)  # -> ListA, ListB
merge_7 = Merge(Data1=dispatch_4.ListA, Data2=dispatch_4.ListB)
lng_12 = ListLength(List=dispatch_3.ListB)
lng_13 = ListLength(List=dispatch_3.ListA)
dup_5 = DuplicateData(Data=panel_32, Number=lng_13, Order=True)
dup_6 = DuplicateData(Data=panel_53, Number=lng_12, Order=True)
entwine_2 = Entwine(Branch00=dup_5, Branch01=clean, FlattenInputs=True)  # -> flatten(Result)
entwine_3 = Entwine(Branch00=eval, Branch01=dup_6, FlattenInputs=True)  # -> flatten(Result)
entwine_4 = Entwine(Branch00=eval, Branch01=dup_6, FlattenInputs=True)  # -> flatten(Result)
entwine_5 = Entwine(Branch00=dup_5, Branch01=clean, FlattenInputs=True)  # -> flatten(Result)

# ----
# list for index 8
sort_2 = SortList(Keys=merge_7, ValuesA=entwine_3)  # -> Keys, ValuesA

# ----
# list for index 17
sort_3 = SortList(Keys=merge_7, ValuesA=entwine_4)  # -> Keys, ValuesA

# ----
# list for index 18
sort_4 = SortList(Keys=merge_7, ValuesA=entwine_5)  # -> Keys, ValuesA

# ----
# list for index 7
sort_5 = SortList(Keys=merge_7, ValuesA=entwine_2)  # -> Keys, ValuesA

# ----
# HVAC Selecting/Aligning
cset_2 = CreateSet(List=panel_27)  # -> Set, Map
mindex_10 = MemberIndex(Set=cset_2.Set, Member=panel_25)  # -> flatten(Index), Count
panel_57 = Panel("""AllAir
HeatCool
DOAS
Null""")
item_15 = ListItem(List=hvac_selection, Index=mindex_10.Index, Wrap=True)
hvac_selected = Panel(item_15)
split_3 = TextSplit(Text=item_15, Separators=":")
item_16 = ListItem(List=split_3, Index=0, Wrap=True)  # -> flatten(Item)
mindex_11 = MemberIndex(Set=item_16, Member=panel_57)  # -> simplify(Index), Count
item_17 = ListItem(List=split_3, Index="1", Wrap=True)  # -> flatten(Item)
bang = ExplodeTree(Data=mindex_11.Index)  # -> Branch0, Branch1, Branch2, Branch3
item_18 = ListItem(List=item_17, Index=[bang.Branch0, bang.Branch1, bang.Branch2, bang.Branch3], Wrap=True)
bang_2 = ExplodeTree(Data=item_18)  # -> Branch0, Branch1, Branch2, Branch3

# ----
# HVAC Selecting/Aligning
cset_3 = CreateSet(List=panel_29)  # -> Set, Map
mindex_12 = MemberIndex(Set=cset_3.Set, Member=replace_2)  # -> flatten(Index), Count
panel_58 = Panel("""AllAir
HeatCool
DOAS
Null""")
item_19 = ListItem(List=hvac_selection_2, Index=mindex_12.Index, Wrap=True)
split_4 = TextSplit(Text=item_19, Separators=":")
hvac_selected_2 = Panel(item_19)
item_20 = ListItem(List=split_4, Index=0, Wrap=True)  # -> flatten(Item)
item_21 = ListItem(List=split_4, Index="1", Wrap=True)  # -> flatten(Item)
mindex_13 = MemberIndex(Set=item_20, Member=panel_58)  # -> simplify(Index), Count
bang_3 = ExplodeTree(Data=mindex_13.Index)  # -> Branch0, Branch1, Branch2, Branch3
item_22 = ListItem(List=item_21, Index=[bang_3.Branch0, bang_3.Branch1, bang_3.Branch2, bang_3.Branch3], Wrap=True)
bang_4 = ExplodeTree(Data=item_22)  # -> Branch0, Branch1, Branch2, Branch3

lng_14 = ListLength(List=sort_5.ValuesA)
lng_15 = ListLength(List=sort_2.ValuesA)
lng_16 = ListLength(List=sort_3.ValuesA)
lng_17 = ListLength(List=sort_4.ValuesA)
series_8 = Series(Start=0, Step=1, Count=lng_14)
series_9 = Series(Start=0, Step=1, Count=lng_15)
series_10 = Series(Start=0, Step=1, Count=lng_16)
series_11 = Series(Start=0, Step=1, Count=lng_17)
item_23 = ListItem(List=sort_5.ValuesA, Index=series_8, Wrap=True)  # -> simplify(graft(Item))
item_24 = ListItem(List=sort_2.ValuesA, Index=series_9, Wrap=True)  # -> simplify(graft(Item))
item_25 = ListItem(List=sort_3.ValuesA, Index=series_10, Wrap=True)  # -> simplify(graft(Item))
item_26 = ListItem(List=sort_4.ValuesA, Index=series_11, Wrap=True)  # -> simplify(graft(Item))

# ----
# replacing the affected hours
# in the default schedule
merge_8 = Merge(Data1=item_23, Data2=item_24, Data3=item_25, Data4=item_26)
panel_59 = Panel("""7
8
17
18""")
replace_8 = ReplaceItems(List=replace_7, Item=merge_8, Indices=panel_59, Wrap=False)

weeklyschedule = HBWeeklySchedule(
    sun=genes,
    mon=replace_8,
    tue=replace_8,
    wed=replace_8,
    thu=replace_8,
    fri=replace_8,
    sat=genes,
    holiday=genes_2,
    name=series_3)  # -> report, simplify(schedule), idf_year, idf_week, idf_days; plug-in component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
path_mapper = PathMapper(weeklyschedule.schedule, source="{A}", target="{0;A}")

people = HBPeople(ppl_per_area=division_2, occupancy_sch=path_mapper)  # -> people; plug-in component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
programtype = HBProgramType(base_program=searchprog, people=people, infiltration=infiltration, setpoint=setpoint)  # -> program; plug-in component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

# ----
# Footprint to Building
panel_60 = Panel("3")
lng_18 = ListLength(List=vizfloors)
dup_7 = DuplicateData(Data=panel_60, Number=sort.ValuesA, Order=True)
series_12 = Series(Start=0, Step=1, Count=lng_18)  # -> graft(Series)
buildingfootprint = DFBuildingFromFootprint(
    footprint_geo=simplify(graft(vizfloors)),
    floor_to_floor=simplify(dup_7),
    name=series_12,
    program=programtype,
    constr_set=constructionset,
    run=Toggle(True))  # -> report, buildings; plug-in component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
topbottom = DFSeparateTopBottom(buildings=buildingfootprint.buildings)  # -> simplify(buildings); plug-in component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

# ----
# Assign Window
lng_19 = ListLength(List=vizfloors)
panel_61 = Panel("""1
2
3
4""")
random_3 = Random(Range=graft(data_26), Number=lng_19, Seed=graft(panel_61))
bang_5 = ExplodeTree(Data=random_3)  # -> Branch0, Branch1, Branch2, Branch3
facparam = HBFacadeParameters(north=bang_5.Branch0, east=bang_5.Branch1, south=bang_5.Branch2, west=bang_5.Branch3)  # -> fac_par; plug-in component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
simpleratiopar = DFSimpleWindowRatioParameters(ratio=facparam)  # -> simplify(win_par); plug-in component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
applyfacadepar = DFApplyFacadeParameters(df_obj=topbottom, win_par=simpleratiopar)  # -> report, df_obj; plug-in component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

item_27 = ListItem(List=flatten(applyfacadepar.df_obj), Index=mindex_11.Index, Wrap=True)
bang_6 = ExplodeTree(Data=item_27)  # -> Branch0, Branch1, Branch2, Branch3
dfdoashvac = DFDOASHVAC(df_objs=simplify(graft(bang_6.Branch2)), system_type=simplify(graft(bang_2.Branch2)))  # -> report, df_objs; plug-in component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
dfallairhvac = DFAllAirHVAC(df_objs=simplify(graft(bang_6.Branch0)), system_type=simplify(graft(bang_2.Branch0)))  # -> report, df_objs; plug-in component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
dfheatcoolhvac = DFHeatCoolHVAC(df_objs=simplify(graft(bang_6.Branch1)), system_type=simplify(graft(bang_2.Branch1)))  # -> report, df_objs; plug-in component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

item_28 = ListItem(List=flatten(applyfacadepar.df_obj), Index=mindex_13.Index, Wrap=True)
bang_7 = ExplodeTree(Data=item_28)  # -> Branch0, Branch1, Branch2, Branch3
dfdoashvac_2 = DFDOASHVAC(df_objs=simplify(graft(bang_7.Branch2)), system_type=simplify(graft(bang_4.Branch2)))  # -> report, df_objs; plug-in component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
dfallairhvac_2 = DFAllAirHVAC(df_objs=simplify(graft(bang_7.Branch0)), system_type=simplify(graft(bang_4.Branch0)))  # -> report, df_objs; plug-in component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
dfheatcoolhvac_2 = DFHeatCoolHVAC(df_objs=simplify(graft(bang_7.Branch1)), system_type=simplify(graft(bang_4.Branch1)))  # -> report, df_objs; plug-in component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

# ----
# All HP Aligned
heatcool = HBHeatCoolHVACTemplates({"Baseboard electric": "ElectricBaseboard", "Baseboard gas boiler": "BoilerBaseboard", "Baseboard central air source heat pump": "ASHPBaseboard", "Baseboard district hot water": "DHWBaseboard", "Direct evap coolers with baseboard electric": "EvapCoolers_ElectricBaseboard", "Direct evap coolers with baseboard gas boiler": "EvapCoolers_BoilerBaseboard"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}, selected="Residential heat pump": "ResidentialHP")
dfheatcoolhvac_3 = DFHeatCoolHVAC(df_objs=simplify(graft(applyfacadepar.df_obj)), system_type=simplify(graft(heatcool)))  # -> report, flatten(df_objs); plug-in component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

# ----
# Percentage HP Aligned
heatcool_2 = HBHeatCoolHVACTemplates({"Baseboard electric": "ElectricBaseboard", "Baseboard gas boiler": "BoilerBaseboard", "Baseboard central air source heat pump": "ASHPBaseboard", "Baseboard district hot water": "DHWBaseboard", "Direct evap coolers with baseboard electric": "EvapCoolers_ElectricBaseboard", "Direct evap coolers with baseboard gas boiler": "EvapCoolers_BoilerBaseboard"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}, selected="Residential heat pump": "ResidentialHP")
entwine_6 = Entwine(
    Branch00=flatten(bang_3.Branch0),
    Branch01=flatten(bang_3.Branch1),
    Branch02=flatten(bang_3.Branch2),
    Branch03=flatten(bang_3.Branch3),
    FlattenInputs=True)  # -> flatten(Result)
panel_62 = Panel(bang_4.Branch1)
entwine_7 = Entwine(
    Branch00=flatten(dfallairhvac_2.df_objs),
    Branch01=flatten(dfheatcoolhvac_2.df_objs),
    Branch02=flatten(dfdoashvac_2.df_objs),
    Branch03=flatten(bang_7.Branch3),
    FlattenInputs=True)  # -> flatten(Result)
toggle_4 = BooleanToggle(False)
dfheatcoolhvac_4 = DFHeatCoolHVAC(df_objs=simplify(graft(applyfacadepar.df_obj)), system_type=simplify(graft(heatcool_2)))  # -> report, flatten(df_objs); plug-in component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
clean_2 = CleanTree(RemoveNulls=True, RemoveInvalid=toggle_4, RemoveEmpty=toggle_4, Tree=entwine_7)
sort_6 = SortList(Keys=entwine_6, ValuesA=clean_2)  # -> Keys, ValuesA

# ----
# Visualization
number_slider_2 = Slider(0, range=0..209)
path_4 = ConstructPath(Indices=number_slider_2)
branch = TreeBranch(Tree=weeklyschedule.schedule, Path=path_4, MaintainPaths=True)
schtodata = HBScheduleToData(schedule=branch)  # -> data; plug-in component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
hourlyplot_3 = LBHourlyPlot(data=schtodata)  # -> report, mesh, legend, borders, labels, title, vis_set; plug-in component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

# ----
# HVAC Aligning
entwine_8 = Entwine(
    Branch00=flatten(bang.Branch0),
    Branch01=flatten(bang.Branch1),
    Branch02=flatten(bang.Branch2),
    Branch03=flatten(bang.Branch3),
    FlattenInputs=True)  # -> flatten(Result)
panel_63 = Panel(bang_2.Branch1)
entwine_9 = Entwine(
    Branch00=flatten(dfallairhvac.df_objs),
    Branch01=flatten(dfheatcoolhvac.df_objs),
    Branch02=flatten(dfdoashvac.df_objs),
    Branch03=flatten(bang_6.Branch3),
    FlattenInputs=True)  # -> flatten(Result)
toggle_5 = BooleanToggle(False)
clean_3 = CleanTree(RemoveNulls=True, RemoveInvalid=toggle_5, RemoveEmpty=toggle_5, Tree=entwine_9)
sort_7 = SortList(Keys=entwine_8, ValuesA=clean_3)  # -> Keys, ValuesA

# ----
# MODELING
panel_64 = Panel(weeklyschedule.schedule)

# ----
# SCENARIO
# SELECTING
entwine_10 = Entwine(Branch00=sort_7.ValuesA, Branch01=dfheatcoolhvac_3.df_objs, Branch02=sort_6.ValuesA, FlattenInputs=True)
panel_65 = Panel("""{0;0}
{0;1}""")
item_29 = ListItem(List=panel_65, Index=item_10, Wrap=True)
branch_2 = TreeBranch(Tree=entwine_10, Path=item_29, MaintainPaths=True)

model = DFModel(buildings=flatten(branch_2), name=item_9)  # -> report, model; plug-in component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
vizall = DFVisualizeAll(df_objs=flatten(model.model))  # -> geo; plug-in component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

# ----
# separate simulation if needed
lng_20 = ListLength(List=vizfloors)  # disabled
path_5 = Slider(8, range=0..8)  # disabled
series_13 = Series(Start=0, Step=1, Count=lng_20)  # disabled
panel_66 = Panel("25")  # disabled
partition = PartitionList(List=series_13, Size=panel_66)  # -> simplify(Chunks); disabled
branch_3 = TreeBranch(Tree=partition, Path=path_5, MaintainPaths=True)  # disabled
item_30 = ListItem(List=branch_2, Index=branch_3, Wrap=True)  # disabled
panel_67 = Panel("7313")  # disabled
model_2 = DFModel(buildings=flatten(item_30), name=panel_67)  # -> report, model; disabled; plug-in component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
item_31 = ListItem(List=panel_39, Index=path_5, Wrap=True)  # disabled
path_6 = FilePath(item_31)  # disabled

# ----
# Create Scenario
# file and URBANopt
# folder Generation
panel_68 = Panel(data_11)
falsestart_3 = LBFalseStartToggle(False)
togeojson = DFModelToGeoJSON(model=model.model, location=importloc, shade_dist="10", network=roads.network, folder=join_5, write=falsestart_3)  # -> report, geojson, net_json, hb_jsons, hb_models; plug-in component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
falsestart_4 = LBFalseStartToggle(False)
runurbanopt = DFRunURBANopt(
    geojson=togeojson.geojson,
    epw_file=path_3,
    sim_par=simpar,
    mappers=add_ev_load.mapper,
    emiss_yr=panel_68,
    run=falsestart_4)  # -> out, scenario, osm, idf, sql, zsz, rdd, html; plug-in component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

path02 = FilePath(runurbanopt.scenario)

path01 = FilePath(togeojson.geojson)
colibri_out = ColibriOutputs(Path01=flatten(path01), Path02=flatten(path02))
colibri_in = ColibriInputsIterator(Index=index, ignoreAllWarningMsg=True)  # -> U, IP, Index, V_N
ca = ColibriAggregator(Folder="c:\Colibri", Inputs=colibri_in.IP, Outputs=colibri_out, Write=Toggle(False), recordingMode=0)
