# Grasshopper definition pipeline_questionnaire.gh (Grasshopper 1.0.8)
# plug-ins: Heteroptera, CORE.Grasshopper.Colibri, LunchBox, LadybugGrasshopper

# ----
# 1) Input the downloaded "Household_Information_Survey.csv" file path
# and turn the toggle to True
file_path_for_the_household_information = Panel("""e.g. 
C:\Users\username\simulation\Household_Inofrmation_Survey.csv""")  # "file path for the Household_information_survey.csv"
# Simulation Process Instruction
turn_to_true_to_process_the_data = LBFalseStartToggle(False)

# ----
# 2) Input the file path that has the building ploygons in GeoJSON format
file_path_for_the_building_ploygons_geoj = Panel("""e.g. 
C:\Users\username\simulation\Building_Polygon.geojson""")  # "file path for the building ploygons GeoJSON file"

# ----
# 4) Input your simulation year
simulation_year = Panel("""e.g.
2050""")

# ----
# 5) Define your simulation output directory path
directory_path_for_your_simulation_outpu = Panel("""e.g.
C:\Users\username\simulation\run""")  # "directory path for your simulation output files"

# ----
# 3) Input the EPW weather file path
file_path_for_epw_file = Panel("""e.g. 
C:\Users\username\simulation\2025_EPWmap.epw""")

# ----
# 6) OPTONAL: Set to True if you only need the input files for UrabnOPT,
# this could be beneficial if you have additional high performance
# computing resources available to run large-scale simulations
falsestart = LBFalseStartToggle(False)

# ----
# 7) Set to True to run the simulation using your local computing resources
falsestart_2 = LBFalseStartToggle(False)

# ----
# Future electricity emissions in metric tons (mt)
# Set to True and the heat map will be shown in Rhino window
electricity_emission_heat_map = LBFalseStartToggle(False)

# ----
# Heat Balance
# Set to True and the stacked bar chart will be shown in Rhino window
monthly_heat_balance = LBFalseStartToggle(False)

# ----
# EUI Color Map
# Set to True and the visualization of each room's EUI as color map will be shown in Rhino window
color_mapping_for_eui = LBFalseStartToggle(False)

# ----
# EUI Heat Map
# Set to True and the heat map will be shown in Rhino window
eui_heat_map = LBFalseStartToggle(False)

path = FilePath(file_path_for_the_building_ploygons_geoj)
path_2 = FilePath(file_path_for_the_household_information)
data = Data(turn_to_true_to_process_the_data)
path_3 = FilePath(file_path_for_epw_file)
data_2 = Data(simulation_year)
data_3 = Data(falsestart_2)
path_4 = FilePath(directory_path_for_your_simulation_outpu)
data_4 = Data(falsestart)

split = TextSplit(Text=path_2, Separators="\")
item = ListItem(List=split, Index=-1, Wrap=True)
split_2 = TextSplit(Text=item, Separators=".")
item_2 = ListItem(List=split_2, Index=0, Wrap=True)
excelread = ExcelReader(ReadExcelData=data, WorkbookPath=path_2, WorksheetName=item_2)  # -> Exceptions, ExcelData
branch = TreeBranch(Tree=excelread.ExcelData, Path="{0}", MaintainPaths=True)
lng = ListLength(List=branch)
subtraction = Subtraction(A=lng, B=1)
series = Series(Start=1, Step=1, Count=10)
series_2 = Series(Start=1, Step=1, Count=subtraction)
item_3 = ListItem(List=excelread.ExcelData, Index=0, Wrap=True)  # -> flatten(Item)
item_4 = ListItem(List=excelread.ExcelData, Index=series_2, Wrap=True)
panel = Panel(item_3)
bang = ExplodeTree(Data=item_4)  # -> Branch0, Branch1, Branch2, Branch3, Branch4, Branch5, Branch6, Branch7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

panel_2 = Panel("Rent/own")
data_5 = Data(bang.Branch2)

panel_3 = Panel("Address")
data_6 = Data(bang.Branch1)

panel_4 = Panel("Model")
data_7 = Data(bang.Branch9)

panel_5 = Panel("Area")
data_8 = Data(bang.Branch12)

data_9 = Data(bang.Branch5)
panel_6 = Panel("Job")

panel_7 = Panel("Occup. num.")
data_10 = Data(bang.Branch3)

panel_8 = Panel("Worker num.")
data_11 = Data(bang.Branch4)

panel_9 = Panel("Ext wall")
data_12 = Data(bang.Branch16)

panel_10 = Panel("Roof")
data_13 = Data(bang.Branch17)

panel_11 = Panel("Int wall")
data_14 = Data(bang.Branch18)

panel_12 = Panel("Floor")
data_15 = Data(bang.Branch19)

panel_13 = Panel("CSP")
data_16 = Data(bang.Branch21)

panel_14 = Panel("Condition")
data_17 = Data(bang.Branch15)

panel_15 = Panel("HSP")
data_18 = Data(bang.Branch20)

panel_16 = Panel("Fuel")
data_19 = Data(bang.Branch22)

panel_17 = Panel("Heating")
data_20 = Data(bang.Branch23)

panel_18 = Panel("Cooling")
data_21 = Data(bang.Branch24)

panel_19 = Panel("Cars")
data_22 = Data(bang.Branch25)

panel_20 = Panel("EV")
data_23 = Data(bang.Branch26)

panel_21 = Panel("Charging")
data_24 = Data(bang.Branch27)

panel_22 = Panel("Weekend")
data_25 = Data(bang.Branch8)

panel_23 = Panel("WWR")
data_26 = Data(bang.Branch11)

panel_24 = Panel("Attic")
data_27 = Data(bang.Branch14)

panel_25 = Panel("Commute")
data_28 = Data(bang.Branch6)

panel_26 = Panel("Workday")
data_29 = Data(bang.Branch7)

panel_27 = Panel("Stories")
data_30 = Data(bang.Branch13)

split_3 = TextSplit(Text=data_18, Separators=" ")
mindex = MemberIndex(Set=split_3, Member="°C")  # -> flatten(Index), Count
mindex_2 = MemberIndex(Set=split_3, Member="°F")  # -> flatten(Index), Count
subtraction_2 = Subtraction(A=mindex.Index, B=1)
subtraction_3 = Subtraction(A=mindex_2.Index, B=1)
item_5 = ListItem(List=split_3, Index=graft(subtraction_2), Wrap=True)  # -> flatten(Item)
item_6 = ListItem(List=split_3, Index=graft(subtraction_3), Wrap=True)  # -> flatten(Item)
num = Number(item_6)
num_2 = Number(item_5)
subtraction_4 = Subtraction(A=num, B=32)
null = NullItem(Item=num_2)  # -> NullFlags, InvalidFlags, Description
division = Division(A=subtraction_4, B=1.8)
mindex_3 = MemberIndex(Set=null.NullFlags, Member=True)  # -> Index, Count
replace = ReplaceItems(List=num_2, Item=division, Indices=mindex_3.Index, Wrap=False)

split_4 = TextSplit(Text=data_16, Separators=" ")
mindex_4 = MemberIndex(Set=split_4, Member="°C")  # -> flatten(Index), Count
mindex_5 = MemberIndex(Set=split_4, Member="°F")  # -> flatten(Index), Count
subtraction_5 = Subtraction(A=mindex_4.Index, B=1)
subtraction_6 = Subtraction(A=mindex_5.Index, B=1)
item_7 = ListItem(List=split_4, Index=graft(subtraction_5), Wrap=True)  # -> flatten(Item)
item_8 = ListItem(List=split_4, Index=graft(subtraction_6), Wrap=True)  # -> flatten(Item)
num_3 = Number(item_8)
num_4 = Number(item_7)
subtraction_7 = Subtraction(A=num_3, B=32)
null_2 = NullItem(Item=num_4)  # -> NullFlags, InvalidFlags, Description
division_2 = Division(A=subtraction_7, B=1.8)
mindex_6 = MemberIndex(Set=null_2.NullFlags, Member=True)  # -> Index, Count
replace_2 = ReplaceItems(List=num_4, Item=division_2, Indices=mindex_6.Index, Wrap=False)

panel_28 = Panel("""Yes
No""")
mindex_7 = MemberIndex(Set=panel_28, Member=data_27)  # -> flatten(Index), Count
panel_29 = Panel("""0.5
0""")
item_9 = ListItem(List=panel_29, Index=mindex_7.Index, Wrap=True)
addition = Addition(A=data_30, B=item_9)
mindex_8 = MemberIndex(Set=addition, Member=0)  # -> Index, Count
replace_3 = ReplaceItems(List=addition, Item=1, Indices=mindex_8.Index, Wrap=False)

ma = MassAddition(Input=data_10)  # -> Result, PartialResults
ma_2 = MassAddition(Input=data_11)  # -> Result, PartialResults

panel_30 = Panel("""I'm currently not working
I'm working from home
about 15mins
about 30mins
about 45mins
about an hour
about an hour and 15mins
about an hour and 30mins
about an hour and 45mins
about two hours""")
mindex_9 = MemberIndex(Set=panel_30, Member=data_28)  # -> flatten(Index), Count
panel_31 = Panel("""0.0
0.0
0.25
0.5
0.75
1.0
1.25
1.5
1.75
2.0""")
item_10 = ListItem(List=panel_31, Index=mindex_9.Index, Wrap=True)

panel_32 = Panel("""Less than 10%
10 - 20%
20 - 30%
30 - 50%
More than 50%""")
mindex_10 = MemberIndex(Set=panel_32, Member=data_26)  # -> flatten(Index), Count
panel_33 = Panel("""0.1
0.15
0.25
0.4
0.6""")
item_11 = ListItem(List=panel_33, Index=mindex_10.Index, Wrap=True)

ma_3 = MassAddition(Input=data_22)  # -> Result, PartialResults
ma_4 = MassAddition(Input=data_23)  # -> Result, PartialResults
division_3 = Division(A=ma_4.Result, B=ma_3.Result)

split_5 = TextSplit(Text=data_29, Separators=" ")
item_12 = ListItem(List=split_5, Index=9, Wrap=True)  # -> flatten(Item)
item_13 = ListItem(List=split_5, Index=11, Wrap=True)  # -> flatten(Item)

split_6 = TextSplit(Text=data_25, Separators=" ")
item_14 = ListItem(List=split_6, Index=9, Wrap=True)  # -> flatten(Item)
item_15 = ListItem(List=split_6, Index=11, Wrap=True)  # -> flatten(Item)

# ----
# EV Percentage
data_31 = Data(division_3)

# ----
# Heating Fuel
# Heating Type
# AC type
# Building HVAC Data Input
data_32 = Data(data_21)
data_33 = Data(data_20)
data_34 = Data(data_19)
merge = Merge(Data1=simplify(graft(data_34)), Data2=simplify(graft(data_33)), Data3=simplify(graft(data_32)))
join = TextJoin(Text=merge, Join=",")  # -> flatten(Result)
panel_34 = Panel(join)

# ----
# Occupancy Number
data_35 = Data(data_10)

# ----
# Story Number
data_36 = Data(replace_3)

# ----
# Worker Number
data_37 = Data(ma_2.Result)

# ----
# 16 Years and Over
data_38 = Data(ma.Result)

# ----
# Grade
data_39 = Data(data_17)

# ----
# Footprint GeoJSON
path_5 = FilePath(path)

toggle = BooleanToggle(True)
fromgeojson = DFModelFromGeoJSON(geojson=path_5, other_geo=toggle, import=toggle)  # -> report, model, other_geo, location, point; plug-in component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
vizfloors = DFVisualizeFloors(df_objs=flatten(fromgeojson.model))  # -> geo; plug-in component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
panel_35 = Panel(data_2)

# ----
# Heating Setpoint
data_40 = Data(replace)

# ----
# Cooling Setpoint
data_41 = Data(replace_2)

# ----
# Employ Rate (1-A)
division_4 = Division(A=data_37, B=data_38)
expression = Expression(x=division_4, Expression="Format(\"{0:0.00}\", x)")

# ----
# Replacing HVAC with HP
list = ValueList({"25%": 0.25, "50%": 0.5, "75%": 0.75, "100%": 1}, selected="25%")
lng_2 = ListLength(List=vizfloors)
multiplication = Multiplication(A=lng_2, B=list)
random = Random(Range=lng_2, Number=multiplication, Seed=2)
replace_4 = ReplaceItems(List=panel_34, Item="Electric,Electric,Heat Pump", Indices=random, Wrap=False)

# ----
# EXT-W
# Roof
# INT-W
# Floor
# Building Data
data_42 = Data(data_14)
data_43 = Data(data_12)
data_44 = Data(data_15)
data_45 = Data(data_13)

# ----
# Stories
int = Integer(data_36)
lng_3 = ListLength(List=int)
equals = Equality(FirstNumber=int, SecondNumber="0")  # -> Equality, Inequality
series_3 = Series(Start="0", Step=1, Count=lng_3)
dispatch = Dispatch(List=series_3, DispatchPattern=equals.Inequality)  # -> ListA, ListB
dispatch_2 = Dispatch(List=int, DispatchPattern=equals.Inequality)  # -> ListA, ListB
lng_4 = ListLength(List=dispatch_2.ListB)
dup = DuplicateData(Data="1", Number=lng_4, Order=True)
merge_2 = Merge(Data1=dispatch.ListA, Data2=dispatch.ListB)  # -> flatten(Result)
merge_3 = Merge(Data1=dispatch_2.ListA, Data2=dup)  # -> flatten(Result)
sort = SortList(Keys=merge_2, ValuesA=merge_3)  # -> Keys, graft(ValuesA)

lng_5 = ListLength(List=vizfloors)
series_4 = Series(Start=0, Step=1, Count=lng_5)

# ----
# setpoint from DOE prototype
panel_36 = Panel("Temperature")
constantschedule = HBConstantSchedule(values=graft(data_40), type_limit=panel_36)  # -> report, schedule, idf_text; plug-in component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
constantschedule_2 = HBConstantSchedule(values=graft(data_41), type_limit=panel_36)  # -> report, schedule, idf_text; plug-in component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
setpoint = HBSetpoint(heating_sch=constantschedule.schedule, cooling_sch=constantschedule_2.schedule)  # -> setpoint; plug-in component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

# ----
# no
# (2-r)>1
# yes
# (2-r)<1
# check if they use
# more than one hour
# on transportation
panel_37 = Panel("2")
subtraction_8 = Subtraction(A=panel_37, B=item_10)
larger = LargerThan(FirstNumber=subtraction_8, SecondNumber="1")  # -> LargerThan, OrEqualTo
dispatch_3 = Dispatch(List=subtraction_8, DispatchPattern=larger.OrEqualTo)  # -> ListA, ListB

# ----
# Data Set
roof = Panel("""I'm not sure
Asbestos shingles
Asphalt, fiberglass, or composite shingles
Clay tiles
Concrete tiles
Metal roofing
Rolled composite roofing
Rubber roofing
Slate tiles
Tar and gravel roof
Wood shingles""")
ext_w = Panel("""I'm not sure
Aluminum or vinyl siding
Asphalt or asbestos siding
Brick and stone construction
Brick and stone veneer
Concrete block construction
Stucco finishes
Wood clapboard siding
Wood shingle siding""")
floor = Panel("""I'm not sure
Carpet
Tile flooring
Hardwood flooring
Softwood flooring
Vinyl flooring""")
int_w = Panel("""I'm not sure
Drywall
Gypsum board
Masonry
Plaster
Wood paneling""")

# ----
# HVAC Selection
heating_fuel_set = Panel("""I don't pay for heating and cooling
Gas
Oil
Electricity
Propane""")
heating_set = Panel("""I don’t use heating
Warm air blown through vents (forced air)
Hot water through radiators or pipes (radiant or baseboard heating)
Electric baseboard heaters
Wood stove or fireplace
Steam radiators
Space heaters (portable electric or gas)
Heat pump (electricity powered air conditioner for both heating and cooling)""")
cooling_set = Panel("""I don't use cooling
Central air conditioning (cooling through whole house vents)
Window or wall air conditioners
Portable air conditioner
Fans only (ceiling or portable)
Heat pump (electricity powered air conditioner for both heating and cooling)""")
crossref = CrossReference(ListA=heating_fuel_set, ListB=heating_set, ListC=cooling_set, CrossMode=1)  # -> graft(ListA), graft(ListB), graft(ListC)
merge_4 = Merge(Data1=crossref.ListA, Data2=crossref.ListB, Data3=crossref.ListC)
hvac_selection = Panel("""HeatCool:BoilerBaseboard
HeatCool:BoilerBaseboard
HeatCool:BoilerBaseboard
HeatCool:ElectricBaseboard
HeatCool:BoilerBaseboard
HeatCool:ResidentialFurnace
HeatCool:ResidentialFurnace
HeatCool:ResidentialFurnace
AllAir:Furnace_Electric
HeatCool:ResidentialFurnace
HeatCool:BoilerBaseboard
HeatCool:BoilerBaseboard
HeatCool:BoilerBaseboard
HeatCool:BoilerBaseboard
HeatCool:BoilerBaseboard
HeatCool:ElectricBaseboard
HeatCool:BoilerBaseboard
HeatCool:BoilerBaseboard
HeatCool:ElectricBaseboard
HeatCool:BoilerBaseboard
AllAir:Furnace
AllAir:Furnace
AllAir:Furnace
AllAir:Furnace
AllAir:Furnace
HeatCool:BoilerBaseboard
HeatCool:BoilerBaseboard
HeatCool:BoilerBaseboard
HeatCool:BoilerBaseboard
HeatCool:BoilerBaseboard
HeatCool:ResidentialHPNoCool
HeatCool:ResidentialHPNoCool
HeatCool:ResidentialHPNoCool
HeatCool:ResidentialHPNoCool
HeatCool:ResidentialHPNoCool
HeatCool:ResidentialHPNoCool
HeatCool:ResidentialHPNoCool
HeatCool:ResidentialHPNoCool
HeatCool:ResidentialHPNoCool
HeatCool:ResidentialHPNoCool
HeatCool:ResidentialAC
HeatCool:ResidentialAC
HeatCool:ResidentialAC
HeatCool:ResidentialAC
HeatCool:ResidentialAC
HeatCool:ResidentialAC_ResidentialFurnace
HeatCool:ResidentialAC_ResidentialFurnace
HeatCool:ResidentialAC_ResidentialFurnace
HeatCool:ResidentialAC_ResidentialFurnace
HeatCool:ResidentialAC_ResidentialFurnace
HeatCool:ResidentialAC_BoilerBaseboard
HeatCool:ResidentialAC_BoilerBaseboard
HeatCool:ResidentialAC_BoilerBaseboard
HeatCool:ResidentialAC_BoilerBaseboard
HeatCool:ResidentialAC_BoilerBaseboard
HeatCool:ResidentialAC_ElectricBaseboard
HeatCool:ResidentialAC_BoilerBaseboard
HeatCool:ResidentialAC_BoilerBaseboard
HeatCool:ResidentialAC_ElectricBaseboard
HeatCool:ResidentialAC_BoilerBaseboard
AllAir:Furnace
AllAir:Furnace
AllAir:Furnace
AllAir:Furnace
AllAir:Furnace
HeatCool:ResidentialAC_BoilerBaseboard
HeatCool:ResidentialAC_BoilerBaseboard
HeatCool:ResidentialAC_BoilerBaseboard
HeatCool:ResidentialAC_BoilerBaseboard
HeatCool:ResidentialAC_BoilerBaseboard
HeatCool:ResidentialHP
HeatCool:ResidentialHP
HeatCool:ResidentialHP
HeatCool:ResidentialAC_ASHPBaseboard
HeatCool:ResidentialHP
HeatCool:ResidentialHP
HeatCool:ResidentialHP
HeatCool:ResidentialHP
HeatCool:ResidentialHP
HeatCool:ResidentialHP
HeatCool:WindowAC
HeatCool:WindowAC
HeatCool:WindowAC
HeatCool:WindowAC
HeatCool:WindowAC
HeatCool:WindowAC_Furnace
HeatCool:WindowAC_Furnace
HeatCool:WindowAC_Furnace
HeatCool:WindowAC_Furnace
HeatCool:WindowAC_Furnace
HeatCool:WindowAC_BoilerBaseboard
HeatCool:WindowAC_BoilerBaseboard
HeatCool:WindowAC_BoilerBaseboard
HeatCool:WindowAC_BoilerBaseboard
HeatCool:WindowAC_BoilerBaseboard
HeatCool:ResidentialAC_ElectricBaseboard
HeatCool:ResidentialAC_BoilerBaseboard
HeatCool:ResidentialAC_BoilerBaseboard
HeatCool:WindowAC_ElectricBaseboard
HeatCool:ResidentialAC_BoilerBaseboard
HeatCool:WindowAC_Furnace
HeatCool:WindowAC_Furnace
HeatCool:WindowAC_Furnace
HeatCool:WindowAC_Furnace
HeatCool:WindowAC_Furnace
HeatCool:WindowAC_BoilerBaseboard
HeatCool:WindowAC_BoilerBaseboard
HeatCool:WindowAC_BoilerBaseboard
HeatCool:WindowAC_BoilerBaseboard
HeatCool:WindowAC_BoilerBaseboard
HeatCool:WindowAC_BoilerBaseboard
HeatCool:WindowAC_BoilerBaseboard
HeatCool:WindowAC_BoilerBaseboard
HeatCool:WindowAC_ElectricBaseboard
HeatCool:WindowAC_BoilerBaseboard
HeatCool:ResidentialHP
HeatCool:ResidentialHP
HeatCool:ResidentialHP
HeatCool:WindowAC_ASHPBaseboard
HeatCool:ResidentialHP
HeatCool:ResidentialAC
HeatCool:ResidentialAC
HeatCool:ResidentialAC
HeatCool:ResidentialAC
HeatCool:ResidentialAC
HeatCool:ResidentialAC_ResidentialFurnace
HeatCool:ResidentialAC_ResidentialFurnace
HeatCool:ResidentialAC_ResidentialFurnace
HeatCool:ResidentialAC_ResidentialFurnace
HeatCool:ResidentialAC_ResidentialFurnace
HeatCool:ResidentialAC_DHWBaseboard
HeatCool:ResidentialAC_DHWBaseboard
HeatCool:ResidentialAC_DHWBaseboard
HeatCool:ResidentialAC_DHWBaseboard
HeatCool:ResidentialAC_DHWBaseboard
HeatCool:ResidentialAC_ElectricBaseboard
HeatCool:ResidentialAC_ElectricBaseboard
HeatCool:ResidentialAC_ElectricBaseboard
HeatCool:ResidentialAC_ElectricBaseboard
HeatCool:ResidentialAC_ElectricBaseboard
HeatCool:ResidentialAC_ResidentialFurnace
HeatCool:ResidentialAC_ResidentialFurnace
HeatCool:ResidentialAC_ResidentialFurnace
HeatCool:ResidentialAC_ResidentialFurnace
HeatCool:ResidentialAC_ResidentialFurnace
HeatCool:ResidentialAC_BoilerBaseboard
HeatCool:ResidentialAC_BoilerBaseboard
HeatCool:ResidentialAC_BoilerBaseboard
HeatCool:ResidentialAC_BoilerBaseboard
HeatCool:ResidentialAC_BoilerBaseboard
HeatCool:ResidentialAC_BoilerBaseboard
HeatCool:ResidentialAC_BoilerBaseboard
HeatCool:ResidentialAC_BoilerBaseboard
HeatCool:ResidentialAC_BoilerBaseboard
HeatCool:ResidentialAC_BoilerBaseboard
HeatCool:ResidentialHP
HeatCool:ResidentialHP
HeatCool:ResidentialHP
HeatCool:ResidentialHP
HeatCool:ResidentialHP
HeatCool:FCU_Chiller
HeatCool:FCU_Chiller
HeatCool:FCU_Chiller
HeatCool:FCU_Chiller
HeatCool:FCU_Chiller
HeatCool:FCU_ACChiller_ASHP
HeatCool:FCU_ACChiller_ASHP
HeatCool:FCU_ACChiller_ASHP
HeatCool:FCU_ACChiller_ASHP
HeatCool:FCU_ACChiller_ASHP
HeatCool:FCU_ACChiller_DHW
HeatCool:FCU_ACChiller_DHW
HeatCool:FCU_ACChiller_DHW
HeatCool:FCU_ACChiller_DHW
HeatCool:FCU_ACChiller_DHW
HeatCool:FCU_ACChiller_ElectricBaseboard
HeatCool:FCU_ACChiller_ElectricBaseboard
HeatCool:FCU_ACChiller_ElectricBaseboard
HeatCool:FCU_ACChiller_ElectricBaseboard
HeatCool:FCU_ACChiller_ElectricBaseboard
HeatCool:FCU_ACChiller_Boiler
HeatCool:FCU_ACChiller_Boiler
HeatCool:FCU_ACChiller_Boiler
HeatCool:FCU_ACChiller_Boiler
HeatCool:FCU_ACChiller_Boiler
HeatCool:FCU_ACChiller_Boiler
HeatCool:FCU_ACChiller_Boiler
HeatCool:FCU_ACChiller_Boiler
HeatCool:FCU_ACChiller_Boiler
HeatCool:FCU_ACChiller_Boiler
HeatCool:FCU_Chiller_GasHeaters
HeatCool:FCU_Chiller_GasHeaters
HeatCool:FCU_Chiller_GasHeaters
HeatCool:FCU_Chiller_GasHeaters
HeatCool:FCU_Chiller_GasHeaters
HeatCool:ResidentialHP
HeatCool:ResidentialHP
HeatCool:ResidentialHP
HeatCool:ResidentialHP
HeatCool:ResidentialHP
HeatCool:ResidentialHP
HeatCool:ResidentialHP
HeatCool:ResidentialHP
HeatCool:ResidentialHP
HeatCool:ResidentialHP
HeatCool:ResidentialHP
HeatCool:ResidentialHP
HeatCool:ResidentialHP
HeatCool:ResidentialHP
HeatCool:ResidentialHP
HeatCool:ResidentialHP
HeatCool:ResidentialHP
HeatCool:ResidentialHP
HeatCool:ResidentialHP
HeatCool:ResidentialHP
HeatCool:ResidentialHP
HeatCool:ResidentialHP
HeatCool:ResidentialHP
HeatCool:ResidentialHP
HeatCool:ResidentialHP
HeatCool:ResidentialHP
HeatCool:ResidentialHP
HeatCool:ResidentialHP
HeatCool:ResidentialHP
HeatCool:ResidentialHP
HeatCool:ResidentialHP
HeatCool:ResidentialHP
HeatCool:ResidentialHP
HeatCool:ResidentialHP
HeatCool:ResidentialHP
HeatCool:ResidentialHP
HeatCool:ResidentialHP
HeatCool:ResidentialHP
HeatCool:ResidentialHP
HeatCool:ResidentialHP
HeatCool:ResidentialHP
HeatCool:ResidentialHP
HeatCool:ResidentialHP
HeatCool:ResidentialHP
HeatCool:ResidentialHP""")
join_2 = TextJoin(Text=merge_4, Join=",")  # -> flatten(Result)
panel_38 = Panel(join_2)

# ----
# Construction Selection
roof_2 = Panel("""Generic Roof
Typical Built Up Roof
Typical Built Up Roof
Typical Built Up Roof
Typical Built Up Roof
Typical Insulated Metal Building Roof
Typical IEAD Roof
Typical IEAD Roof
Typical IEAD Roof
Typical Built Up Roof
Typical Built Up Roof""")
floor_2 = Panel("""Generic Interior Floor
Typical Carpeted 4in Slab Floor
Generic Interior Floor
Typical Wood Joist Attic Floor
Typical Wood Joist Attic Floor
Typical Interior Floor""")
int_w_2 = Panel("""Generic Interior Wall
Typical Interior Wall
Typical Unninsulated Interior Wall
Typical Interior Partition
Typical Interior Wall
Typical Interior Wall""")
ext_w_2 = Panel("""Generic Exterior Wall
Typical Insulated Steel Framed Exterior Wall
Generic Exterior Wall
Typical Insulated Exterior Mass Wall
Typical Insulated Exterior Mass Wall
Typical Insulated Exterior Mass Wall
Typical Insulated Exterior Mass Wall
Typical Insulated Wood Framed Exterior Wall
Typical Insulated Steel Framed Exterior Wall""")

# ----
# EX-W
# Roof
# IN-W
# Floor
panel_39 = Panel("5A")
constrsetclimate = HBConstructionSetByClimate(climate_zone=panel_39)  # -> constr_set; plug-in component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
mindex_11 = MemberIndex(Set=ext_w, Member=data_43)  # -> Index, Count
mindex_12 = MemberIndex(Set=roof, Member=data_45)  # -> Index, Count
mindex_13 = MemberIndex(Set=int_w, Member=data_42)  # -> Index, Count
mindex_14 = MemberIndex(Set=floor, Member=data_44)  # -> Index, Count
item_16 = ListItem(List=ext_w_2, Index=mindex_11.Index, Wrap=True)
item_17 = ListItem(List=roof_2, Index=mindex_12.Index, Wrap=True)
item_18 = ListItem(List=int_w_2, Index=mindex_13.Index, Wrap=True)
item_19 = ListItem(List=floor_2, Index=mindex_14.Index, Wrap=True)

# ----
# HVAC Selection
heating_set_2 = Panel("""Null
Typical
Water Fh
Forced Air
Steam
Electric
Heat Pump""")
cooling_set_2 = Panel("""Null
Wall Units
Central
Heat Pump""")
heating_fuel_set_2 = Panel("""Null
Gas
Oil
Electric
Propane""")
crossref_2 = CrossReference(ListA=heating_fuel_set_2, ListB=heating_set_2, ListC=cooling_set_2, CrossMode=1)  # -> graft(ListA), graft(ListB), graft(ListC)
merge_5 = Merge(Data1=crossref_2.ListA, Data2=crossref_2.ListB, Data3=crossref_2.ListC)
hvac_selection_2 = Panel("""Null: 
Null: 
Null: 
Null: 
Null: 
HeatCool:BoilerBaseboard
HeatCool:BoilerBaseboard
HeatCool:BoilerBaseboard
HeatCool:ElectricBaseboard
HeatCool:BoilerBaseboard
HeatCool:BoilerBaseboard
HeatCool:BoilerBaseboard
HeatCool:BoilerBaseboard
HeatCool:BoilerBaseboard
HeatCool:BoilerBaseboard
HeatCool:ResidentialFurnace
HeatCool:ResidentialFurnace
HeatCool:ResidentialFurnace
AllAir:Furnace_Electric
HeatCool:ResidentialFurnace
HeatCool:BoilerBaseboard
HeatCool:BoilerBaseboard
HeatCool:BoilerBaseboard
HeatCool:BoilerBaseboard
HeatCool:BoilerBaseboard
Null: 
Null: 
Null: 
HeatCool:ElectricBaseboard
Null: 
Null: 
Null: 
Null: 
HeatCool:ResidentialHPNoCool
Null: 
HeatCool:WindowAC
HeatCool:WindowAC
HeatCool:WindowAC
HeatCool:WindowAC
HeatCool:WindowAC
HeatCool:WindowAC_BoilerBaseboard
HeatCool:WindowAC_BoilerBaseboard
HeatCool:WindowAC_BoilerBaseboard
HeatCool:WindowAC_ElectricBaseboard
HeatCool:WindowAC_BoilerBaseboard
HeatCool:WindowAC_BoilerBaseboard
HeatCool:WindowAC_BoilerBaseboard
HeatCool:WindowAC_BoilerBaseboard
HeatCool:WindowAC_BoilerBaseboard
HeatCool:WindowAC_BoilerBaseboard
HeatCool:WindowAC_Furnace
HeatCool:WindowAC_Furnace
HeatCool:WindowAC_Furnace
HeatCool:WindowAC_Furnace
HeatCool:WindowAC_Furnace
HeatCool:WindowAC_BoilerBaseboard
HeatCool:WindowAC_BoilerBaseboard
HeatCool:WindowAC_BoilerBaseboard
HeatCool:WindowAC_BoilerBaseboard
HeatCool:WindowAC_BoilerBaseboard
Null: 
Null: 
Null: 
HeatCool:WindowAC_ElectricBaseboard
Null: 
Null: 
Null: 
Null: 
HeatCool:WindowAC_ASHPBaseboard
Null: 
HeatCool:ResidentialAC
HeatCool:ResidentialAC
HeatCool:ResidentialAC
HeatCool:ResidentialAC
HeatCool:ResidentialAC
HeatCool:ResidentialAC_BoilerBaseboard
HeatCool:ResidentialAC_BoilerBaseboard
HeatCool:ResidentialAC_BoilerBaseboard
HeatCool:ResidentialAC_ElectricBaseboard
HeatCool:ResidentialAC_BoilerBaseboard
HeatCool:ResidentialAC_BoilerBaseboard
HeatCool:ResidentialAC_BoilerBaseboard
HeatCool:ResidentialAC_BoilerBaseboard
HeatCool:ResidentialAC_BoilerBaseboard
HeatCool:ResidentialAC_BoilerBaseboard
HeatCool:ResidentialAC_ResidentialFurnace
HeatCool:ResidentialAC_ResidentialFurnace
HeatCool:ResidentialAC_ResidentialFurnace
HeatCool:ResidentialAC_ResidentialFurnace
HeatCool:ResidentialAC_ResidentialFurnace
HeatCool:ResidentialAC_BoilerBaseboard
HeatCool:ResidentialAC_BoilerBaseboard
HeatCool:ResidentialAC_BoilerBaseboard
HeatCool:ResidentialAC_BoilerBaseboard
HeatCool:ResidentialAC_BoilerBaseboard
Null: 
Null: 
Null: 
HeatCool:ResidentialAC_ElectricBaseboard
Null: 
Null: 
Null: 
Null: 
HeatCool:ResidentialAC_ASHPBaseboard
Null: 
HeatCool:ResidentialHP
HeatCool:ResidentialHP
HeatCool:ResidentialHP
HeatCool:WindowAC
HeatCool:ResidentialHP
HeatCool:WindowAC_BoilerBaseboard
HeatCool:WindowAC_BoilerBaseboard
HeatCool:WindowAC_BoilerBaseboard
HeatCool:ResidentialHP
HeatCool:WindowAC_BoilerBaseboard
HeatCool:WindowAC_BoilerBaseboard
HeatCool:WindowAC_BoilerBaseboard
HeatCool:WindowAC_BoilerBaseboard
HeatCool:WindowAC_BoilerBaseboard
HeatCool:WindowAC_BoilerBaseboard
HeatCool:ResidentialAC_ResidentialFurnace
HeatCool:ResidentialAC_ResidentialFurnace
HeatCool:ResidentialAC_ResidentialFurnace
HeatCool:ResidentialAC_ResidentialFurnace
HeatCool:ResidentialAC_ResidentialFurnace
HeatCool:WindowAC_BoilerBaseboard
HeatCool:WindowAC_BoilerBaseboard
HeatCool:WindowAC_BoilerBaseboard
HeatCool:WindowAC_BoilerBaseboard
HeatCool:WindowAC_BoilerBaseboard
Null: 
Null: 
Null: 
HeatCool:ResidentialHP
Null: 
Null: 
Null: 
Null: 
HeatCool:ResidentialHP
Null: """)
join_3 = TextJoin(Text=merge_5, Join=",")  # -> flatten(Result)
panel_40 = Panel(join_3)

# ----
# Leakyness
panel_41 = Panel("""0
Poor
Poor To Fair
Fair
Fair To Avg
Average
Avg To Good
Good
Good To Vg
Very Good
Vg To Exc
Excellent""")
mindex_15 = MemberIndex(Set=panel_41, Member=data_39)  # -> Index, Count
panel_42 = Panel("""0.0003
0.0001
0.00015
0.0002
0.00025
0.0003
0.00035
0.0004
0.00045
0.0005
0.00055
0.0006""")
item_20 = ListItem(List=panel_42, Index=mindex_15.Index, Wrap=True)

# ----
# for index 7 and 18 when (2-r)>1
panel_43 = Panel("1")

# ----
# Construction
interiorsubset = HBInteriorConstructionSubset(interior_wall=item_18)  # -> interior_set; plug-in component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
subfacesubset = HBSubfaceSubset()  # -> subface_set; plug-in component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
exteriorsubset = HBExteriorConstructionSubset(exterior_wall=item_16, exterior_roof=item_17, exposed_floor=item_19)  # -> exterior_set; plug-in component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
groundsubset = HBGroundConstructionSubset()  # -> ground_set; plug-in component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
constructionset = HBConstructionSet(
    base_constr_set=constrsetclimate,
    exterior_subset=exteriorsubset,
    ground_subset=groundsubset,
    interior_subset=interiorsubset,
    subface_subset=subfacesubset)  # -> constr_set; plug-in component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

# ----
# index of households working at home or not
panel_44 = Panel("0")
equals_2 = Equality(FirstNumber=item_10, NotGoingToWork=panel_44)  # -> Equality, Inequality
mindex_16 = MemberIndex(Set=equals_2.Equality, Member=Toggle(True))  # -> Index, Count
mindex_17 = MemberIndex(Set=equals_2.Equality, Member=Toggle(False))  # -> Index, Count

# ----
# index of households working at home or not
panel_45 = Panel("0")
equals_3 = Equality(FirstNumber=item_10, NotGoingToWork=panel_45)  # -> Equality, Inequality
mindex_18 = MemberIndex(Set=equals_3.Equality, Member=Toggle(True))  # -> Index, Count
mindex_19 = MemberIndex(Set=equals_3.Equality, Member=Toggle(False))  # -> Index, Count

panel_46 = Panel("Typical Public")

# ----
# Charging Behavior
list_2 = ValueList({"non-WFH charging behavior": "Business as usual", "WFH charging behavior": "Free Workplace Charging at Project Site", "charge mostly at work": "Free Workplace Charging Across Metro Area"}, selected="WFH charging behavior")
list_3 = ValueList({"non-WFH charging behavior": "Business as usual", "WFH charging behavior": "Free Workplace Charging at Project Site", "charge mostly at work": "Free Workplace Charging Across Metro Area"}, selected="non-WFH charging behavior")
lng_6 = ListLength(List=vizfloors)
series_5 = Series(Start=0, Step=1, Count=lng_6)
replace_5 = ReplaceItems(List=series_5, Item=list_2, Indices=mindex_16.Index, Wrap=False)
replace_6 = ReplaceItems(List=replace_5, Item=list_3, Indices=mindex_17.Index, Wrap=False)

# ----
# Charging Station type
lng_7 = ListLength(List=vizfloors)
series_6 = Series(Start=0, Step=1, Count=lng_7)
replace_7 = ReplaceItems(List=series_6, Item="Typical Home", Indices=mindex_18.Index, Wrap=False)
replace_8 = ReplaceItems(List=replace_7, Item="Typical Work", Indices=mindex_19.Index, Wrap=False)

# ----
# EV Charging
panel_47 = Panel("C:\URBANopt-cli-0.14.0\gems\ruby\2.7.0\gems\openstudio-common-measures-gem-0.9.0\lib\measures\add_ev_load")
add_ev_load = Add_EV_Load(measure_path=panel_47, charge_behavior=replace_6, chg_station_type=replace_8, ev_percent=data_31)  # -> report, flatten(mapper); plug-in component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

# ----
# generate the DDY file
rep = ReplaceText(Text=path_3, Find="/", Replace="\", RecursiveReplace=False)
split_7 = TextSplit(Text=rep, Separators="\")
lng_8 = ListLength(List=split_7)
subtraction_9 = Subtraction(A=lng_8, B=1)
series_7 = Series(Start=0, Step=1, Count=subtraction_9)
item_21 = ListItem(List=split_7, Index=series_7, Wrap=True)
join_4 = TextJoin(Text=item_21, Join="\")
epwtoddy = LBEPWToDDY(weather_file=path_3, folder=join_4, write=Toggle(True))  # -> ddy_file; plug-in component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

panel_48 = Panel("Z:\simulation\CHANDLER_before_0428\filtered_row.csv")  # disabled
file = ReadFile(File=panel_48, PerLineParse=True)  # disabled
csv = ReadCSV(CSVString=file, Delimiter=",")  # -> Headers, Values; disabled
panel_49 = Panel(csv.Headers)  # disabled
panel_50 = Panel(csv.Values)  # disabled
cset = CreateSet(List=panel_50)  # -> Set, Map; disabled
lng_9 = ListLength(List=cset.Set)  # disabled
series_8 = Series(Start=0, Step=1, Count=lng_9)  # disabled
extremes = MinMax(Number=series_8)  # -> Minimum, Maximum; disabled
gradient = Gradient(
    LowerLimit=extremes.Minimum,
    UpperLimit=extremes.Maximum,
    Parameter=cset.Map,
    stops=[0: RGB(243, 57, 0), 0.1: RGB(236, 27, 60), 0.2: RGB(210, 0, 118), 0.3: RGB(103, 0, 120), 0.4: RGB(39, 72, 161), 0.5: RGB(1, 192, 229), 0.6: RGB(18, 178, 90), 0.7: RGB(79, 186, 8), 0.8: RGB(220, 237, 32), 0.9: RGB(247, 159, 20), 1: RGB(243, 57, 0)])  # disabled
legendpar = LBLegendParameters(seg_count=lng_9, colors=gradient)  # -> leg_par; disabled; plug-in component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
panel_51 = Panel("2%")  # disabled
legend2d = LBLegend2DParameters(seg_height=panel_51)  # -> leg_par2d; disabled; plug-in component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
preview = CustomPreview(Geometry=vizfloors, Material=gradient)  # disabled
createlegend = LBCreateLegend(values=series_8, legend_par=legendpar, leg_par2d=legend2d)  # -> mesh, title_obj, label_objs, label_text, colors; disabled; plug-in component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

# ----
# Road Network
toggle_2 = BooleanToggle(True)
fromgeojson_2 = DFModelFromGeoJSON(geojson=path_5, all_to_bldg=toggle_2, import=toggle_2)  # -> report, model, other_geo, location, point; plug-in component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
vizfloors_2 = DFVisualizeFloors(df_objs=flatten(fromgeojson_2.model))  # -> geo; plug-in component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
item_22 = ListItem(List=vizfloors_2, Index=expr("-1", 0), Wrap=True)
geo = Geometry(fromgeojson.other_geo)
substation = DFSubstation(geo=item_22)  # -> substation; plug-in component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
topoly = CurveToPolyline(Curve=geo, ToleranceDistance=0, ToleranceAngle=0)  # -> Polyline, Segments
roads = DFRoadNetwork(substation=substation, road_geo=flatten(topoly.Polyline))  # -> report, network; plug-in component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

split_8 = TextSplit(Text=path_2, Separators=".")
item_23 = ListItem(List=split_8, Index=0, Wrap=True)
split_9 = TextSplit(Text=item_23, Separators="\")
item_24 = ListItem(List=split_9, Index=-1, Wrap=True)

list_4 = ValueList({"Original Scenario": 0, "Electrified Scenario": 1, "Percentage Electrified": 2}, selected="Original Scenario")
index = Slider(0, range=0..13)
panel_52 = Panel("""0
1
0
1
0
1
0
1
0
1
0
1
0
1""")
item_25 = ListItem(List=panel_52, Index=index, Wrap=True)

# ----
# Weather File
panel_53 = Panel(path_3)
path_6 = FilePath(panel_53)
# RUN SIMULATION
importloc = LBImportLocation(epw_file=path_6)  # -> location; plug-in component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

toggle_3 = BooleanToggle(True)
simoutput = HBSimulationOutput(zone_energy_use=toggle_3, system_energy_use=toggle_3, gains_and_losses=toggle_3, comfort_metrics=toggle_3)  # -> report, sim_output; plug-in component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
customoutput = HBCustomSimulationOutput(base_sim_output=simoutput.sim_output, output_names="Exterior Equipment Electricity Energy")  # -> report, sim_output; plug-in component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
simpar = HBSimulationParameter(output=customoutput.sim_output, timestep="1")  # -> sim_par; plug-in component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

# ----
# Grid Load
falsestart_3 = LBFalseStartToggle(False)
falsestart_4 = LBFalseStartToggle(False)
newtworkattr = DFNetworkAttributes({"Display Name": "display_name", "Simulation Name (Identifier)": "identifier", "Nominal Voltage": "nominal_voltage", "Phase Count": "phase_count", "Wire Count": "power_line.wire_count", "Wire Phases": "power_line.phases"}, selected="Nominal Voltage")
runrnm = DFRunRNM(run=falsestart_3)  # -> report, network, dss_results; plug-in component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
runopendss = DFRunOpenDSS(run=falsestart_4)  # -> report, buildings, connectors, transformers; plug-in component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
colornetattr = DFColorNetworkAttributes(network=runrnm.network, attribute=newtworkattr)  # -> vis_geo, legend, values, colors; plug-in component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
opendssresult = DFReadOpenDSSResult(dss_csv=runopendss.buildings)  # -> factors, condition; plug-in component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
hourlyplot = LBHourlyPlot(data=opendssresult.factors, x_dim="4")  # -> report, mesh, legend, borders, labels, title, vis_set; plug-in component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

# ----
# Peak Load Hour
# Select the month and the peak load hour will be shown in the panel
list_5 = ValueList({"January": 1, "February": 2, "March": 3, "April": 4, "May": 5, "June": 6, "July": 7, "August": 8, "September": 9, "October": 10, "November": 11, "December": 12}, selected="January")

# ----
# Occupancy Schedule
panel_54 = Panel("1")
subtraction_10 = Subtraction(A=panel_54, B=expression)
num_5 = Number(subtraction_10)
lng_10 = ListLength(List=subtraction_8)
series_9 = Series(Start="0", Step=1, Count=lng_10)
dispatch_4 = Dispatch(List=series_9, DispatchPattern=larger.OrEqualTo)  # -> ListA, ListB
merge_6 = Merge(Data1=dispatch_4.ListA, Data2=dispatch_4.ListB)
lng_11 = ListLength(List=dispatch_3.ListB)
lng_12 = ListLength(List=dispatch_3.ListA)
dup_2 = DuplicateData(Data=panel_43, Number=lng_12, Order=True)
panel_55 = Panel("Occupancy Schedule")
lng_13 = ListLength(List=vizfloors)
series_10 = Series(Start=0, Step=1, Count=lng_13)  # -> graft(Series)
genes = GenePool(Decimals=2, Maximum=1, Minimum=0, Value=[1, 1, 1, 1, 1, 1, 1, 1, 1, 1, 1, 1, 1, 1, 1, 1, 1, 1, 1, 1, 1, 1, 1, 1])

# ----
# for index 8 and 17 when (2-r)>1
index_2 = ItemIndex(List=subtraction_8, Item=dispatch_3.ListA)
item_26 = ListItem(List=item_10, Index=index_2, Wrap=True)
eval = Evaluate(F="1-(1-A)*r", r=item_26, A=num_5)

# ----
# for index 7 and 18 when (2-r)<1
index_3 = ItemIndex(List=subtraction_8, Item=dispatch_3.ListB)
item_27 = ListItem(List=item_10, Index=index_3, Wrap=True)
eval_2 = Evaluate(F="1-(1-A)*(r-1)", r=item_27, A=num_5)
clean = CleanTree(RemoveNulls=True, RemoveInvalid=True, RemoveEmpty=False, Tree=eval_2)

# ----
# for index 8 and 17 when (2-r)<1
panel_56 = Panel(num_5)

# ----
# Default Occupancy Schedule
subtraction_11 = Subtraction(A=item_12, B=1)
subtraction_12 = Subtraction(A=item_13, B=subtraction_11)
num_6 = Number(num_5)
dup_3 = DuplicateData(Data="1", Number="24", Order=True)
series_11 = Series(Start=item_12, Step=1, Count=subtraction_12)
replace_9 = ReplaceItems(List=dup_3, Item=num_6, Indices=series_11, Wrap=False)

# ----
# Occupancy Schedule Weedend
subtraction_13 = Subtraction(A=item_14, B=1)
subtraction_14 = Subtraction(A=item_15, B=subtraction_13)
num_7 = Number(num_5)
dup_4 = DuplicateData(Data=num_7, Number="24", Order=True)
series_12 = Series(Start=item_14, Step=1, Count=subtraction_14)
replace_10 = ReplaceItems(List=dup_4, Item="1", Indices=series_12, Wrap=False)

# ----
# Footprint to Building
item_28 = ListItem(List=vizfloors, Index=series_4, Wrap=True)
lng_14 = ListLength(List=vizfloors)
dup_5 = DuplicateData(Data="3", Number=sort.ValuesA, Order=True)
series_13 = Series(Start=0, Step=1, Count=lng_14)  # -> graft(Series)

# ----
# Program
bldgprograms = HBBuildingPrograms({"LargeOffice", "MediumOffice", "SmallOffice", "MidriseApartment", "HighriseApartment", "Retail", "StripMall", "PrimarySchool", "SecondarySchool", "SmallHotel", "LargeHotel", "Hospital", "Outpatient", "Laboratory", "Warehouse", "SuperMarket", "FullServiceRestaurant", "QuickServiceRestaurant", "Courthouse", "College", "LargeDataCenterHighITE", "LargeDataCenterLowITE", "SmallDataCenterHighITE", "SmallDataCenterLowITE"}, selected="MidriseApartment")
searchprog = HBSearchPrograms(bldg_prog=bldgprograms, keywords="Apartment")  # -> room_prog; plug-in component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
area = Area(Geometry=vizfloors)  # -> Area, Centroid
division_5 = Division(A=graft(data_35), B=graft(area.Area))
infiltration = HBInfiltration(flow_per_ext_area=item_20)  # -> infil; plug-in component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

dup_6 = DuplicateData(Data=panel_56, Number=lng_11, Order=True)
entwine = Entwine(Branch00=dup_2, Branch01=clean, FlattenInputs=True)  # -> flatten(Result)
entwine_2 = Entwine(Branch00=eval, Branch01=dup_6, FlattenInputs=True)  # -> flatten(Result)
entwine_3 = Entwine(Branch00=eval, Branch01=dup_6, FlattenInputs=True)  # -> flatten(Result)
entwine_4 = Entwine(Branch00=dup_2, Branch01=clean, FlattenInputs=True)  # -> flatten(Result)

# ----
# list for index 8
sort_2 = SortList(Keys=merge_6, ValuesA=entwine_2)  # -> Keys, ValuesA

# ----
# list for index 17
sort_3 = SortList(Keys=merge_6, ValuesA=entwine_3)  # -> Keys, ValuesA

# ----
# list for index 18
sort_4 = SortList(Keys=merge_6, ValuesA=entwine_4)  # -> Keys, ValuesA

# ----
# list for index 7
sort_5 = SortList(Keys=merge_6, ValuesA=entwine)  # -> Keys, ValuesA

# ----
# HVAC Selecting/Aligning
cset_2 = CreateSet(List=panel_38)  # -> Set, Map
mindex_20 = MemberIndex(Set=cset_2.Set, Member=panel_34)  # -> flatten(Index), Count
panel_57 = Panel("""AllAir
HeatCool
DOAS
Null""")
item_29 = ListItem(List=hvac_selection, Index=mindex_20.Index, Wrap=True)
hvac_selected = Panel(item_29)
split_10 = TextSplit(Text=item_29, Separators=":")
item_30 = ListItem(List=split_10, Index=0, Wrap=True)  # -> flatten(Item)
mindex_21 = MemberIndex(Set=item_30, Member=panel_57)  # -> simplify(Index), Count
item_31 = ListItem(List=split_10, Index="1", Wrap=True)  # -> flatten(Item)
bang_2 = ExplodeTree(Data=mindex_21.Index)  # -> Branch0, Branch1, Branch2, Branch3
item_32 = ListItem(List=item_31, Index=[bang_2.Branch0, bang_2.Branch1, bang_2.Branch2, bang_2.Branch3], Wrap=True)
bang_3 = ExplodeTree(Data=item_32)  # -> Branch0, Branch1, Branch2, Branch3

# ----
# HVAC Selecting/Aligning
cset_3 = CreateSet(List=panel_40)  # -> Set, Map
mindex_22 = MemberIndex(Set=cset_3.Set, Member=replace_4)  # -> flatten(Index), Count
panel_58 = Panel("""AllAir
HeatCool
DOAS
Null""")
item_33 = ListItem(List=hvac_selection_2, Index=mindex_22.Index, Wrap=True)
split_11 = TextSplit(Text=item_33, Separators=":")
hvac_selected_2 = Panel(item_33)
item_34 = ListItem(List=split_11, Index=0, Wrap=True)  # -> flatten(Item)
item_35 = ListItem(List=split_11, Index="1", Wrap=True)  # -> flatten(Item)
mindex_23 = MemberIndex(Set=item_34, Member=panel_58)  # -> simplify(Index), Count
bang_4 = ExplodeTree(Data=mindex_23.Index)  # -> Branch0, Branch1, Branch2, Branch3
item_36 = ListItem(List=item_35, Index=[bang_4.Branch0, bang_4.Branch1, bang_4.Branch2, bang_4.Branch3], Wrap=True)
bang_5 = ExplodeTree(Data=item_36)  # -> Branch0, Branch1, Branch2, Branch3

lng_15 = ListLength(List=sort_5.ValuesA)
lng_16 = ListLength(List=sort_2.ValuesA)
lng_17 = ListLength(List=sort_3.ValuesA)
lng_18 = ListLength(List=sort_4.ValuesA)
series_14 = Series(Start=0, Step=1, Count=lng_15)
series_15 = Series(Start=0, Step=1, Count=lng_16)
series_16 = Series(Start=0, Step=1, Count=lng_17)
series_17 = Series(Start=0, Step=1, Count=lng_18)
item_37 = ListItem(List=sort_5.ValuesA, Index=series_14, Wrap=True)  # -> simplify(graft(Item))
item_38 = ListItem(List=sort_2.ValuesA, Index=series_15, Wrap=True)  # -> simplify(graft(Item))
item_39 = ListItem(List=sort_3.ValuesA, Index=series_16, Wrap=True)  # -> simplify(graft(Item))
item_40 = ListItem(List=sort_4.ValuesA, Index=series_17, Wrap=True)  # -> simplify(graft(Item))

# ----
# replacing the affected hours
# in the default schedule
merge_7 = Merge(Data1=item_37, Data2=item_38, Data3=item_39, Data4=item_40)
panel_59 = Panel("""7
8
17
18""")
replace_11 = ReplaceItems(List=replace_9, Item=merge_7, Indices=panel_59, Wrap=False)

weeklyschedule = HBWeeklySchedule(
    sun=replace_10,
    mon=replace_11,
    tue=replace_11,
    wed=replace_11,
    thu=replace_11,
    fri=replace_11,
    sat=replace_10,
    holiday=genes,
    name=series_10)  # -> report, simplify(schedule), idf_year, idf_week, idf_days; plug-in component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
path_mapper = PathMapper(weeklyschedule.schedule, source="{A}", target="{0;A}")

people = HBPeople(ppl_per_area=division_5, occupancy_sch=path_mapper)  # -> people; plug-in component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
programtype = HBProgramType(base_program=searchprog, people=people, infiltration=infiltration, setpoint=setpoint)  # -> program; plug-in component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

buildingfootprint = DFBuildingFromFootprint(
    footprint_geo=simplify(graft(vizfloors)),
    floor_to_floor=simplify(dup_5),
    name=series_13,
    program=programtype,
    constr_set=constructionset,
    run=Toggle(True))  # -> report, buildings; plug-in component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
topbottom = DFSeparateTopBottom(buildings=buildingfootprint.buildings)  # -> simplify(buildings); plug-in component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

# ----
# Visualization
number_slider = Slider(0, range=0..10)
path_7 = ConstructPath(Indices=number_slider)
branch_2 = TreeBranch(Tree=weeklyschedule.schedule, Path=path_7, MaintainPaths=True)
schtodata = HBScheduleToData(schedule=branch_2)  # -> data; plug-in component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
hourlyplot_2 = LBHourlyPlot(data=schtodata)  # -> report, mesh, legend, borders, labels, title, vis_set; plug-in component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

# ----
# Assign Window
simpleratiopar = DFSimpleWindowRatioParameters(ratio=item_11)  # -> simplify(win_par); plug-in component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
applyfacadepar = DFApplyFacadeParameters(df_obj=topbottom, win_par=simpleratiopar)  # -> report, df_obj; plug-in component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

item_41 = ListItem(List=flatten(applyfacadepar.df_obj), Index=mindex_21.Index, Wrap=True)
bang_6 = ExplodeTree(Data=item_41)  # -> Branch0, Branch1, Branch2, Branch3
dfdoashvac = DFDOASHVAC(df_objs=simplify(graft(bang_6.Branch2)), system_type=simplify(graft(bang_3.Branch2)))  # -> report, df_objs; plug-in component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
dfallairhvac = DFAllAirHVAC(df_objs=simplify(graft(bang_6.Branch0)), system_type=simplify(graft(bang_3.Branch0)))  # -> report, df_objs; plug-in component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
dfheatcoolhvac = DFHeatCoolHVAC(df_objs=simplify(graft(bang_6.Branch1)), system_type=simplify(graft(bang_3.Branch1)))  # -> report, df_objs; plug-in component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

item_42 = ListItem(List=flatten(applyfacadepar.df_obj), Index=mindex_23.Index, Wrap=True)
bang_7 = ExplodeTree(Data=item_42)  # -> Branch0, Branch1, Branch2, Branch3
dfdoashvac_2 = DFDOASHVAC(df_objs=simplify(graft(bang_7.Branch2)), system_type=simplify(graft(bang_5.Branch2)))  # -> report, df_objs; plug-in component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
dfallairhvac_2 = DFAllAirHVAC(df_objs=simplify(graft(bang_7.Branch0)), system_type=simplify(graft(bang_5.Branch0)))  # -> report, df_objs; plug-in component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
dfheatcoolhvac_2 = DFHeatCoolHVAC(df_objs=simplify(graft(bang_7.Branch1)), system_type=simplify(graft(bang_5.Branch1)))  # -> report, df_objs; plug-in component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

# ----
# All HP Aligned
heatcool = HBHeatCoolHVACTemplates({"Baseboard electric": "ElectricBaseboard", "Baseboard gas boiler": "BoilerBaseboard", "Baseboard central air source heat pump": "ASHPBaseboard", "Baseboard district hot water": "DHWBaseboard", "Direct evap coolers with baseboard electric": "EvapCoolers_ElectricBaseboard", "Direct evap coolers with baseboard gas boiler": "EvapCoolers_BoilerBaseboard"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}, selected="Residential heat pump": "ResidentialHP")
dfheatcoolhvac_3 = DFHeatCoolHVAC(df_objs=simplify(graft(applyfacadepar.df_obj)), system_type=simplify(graft(heatcool)))  # -> report, flatten(df_objs); plug-in component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

# ----
# Percentage HP Aligned
heatcool_2 = HBHeatCoolHVACTemplates({"Baseboard electric": "ElectricBaseboard", "Baseboard gas boiler": "BoilerBaseboard", "Baseboard central air source heat pump": "ASHPBaseboard", "Baseboard district hot water": "DHWBaseboard", "Direct evap coolers with baseboard electric": "EvapCoolers_ElectricBaseboard", "Direct evap coolers with baseboard gas boiler": "EvapCoolers_BoilerBaseboard"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}, selected="Residential heat pump": "ResidentialHP")
entwine_5 = Entwine(
    Branch00=flatten(bang_4.Branch0),
    Branch01=flatten(bang_4.Branch1),
    Branch02=flatten(bang_4.Branch2),
    Branch03=flatten(bang_4.Branch3),
    FlattenInputs=True)  # -> flatten(Result)
panel_60 = Panel(bang_5.Branch1)
entwine_6 = Entwine(
    Branch00=flatten(dfallairhvac_2.df_objs),
    Branch01=flatten(dfheatcoolhvac_2.df_objs),
    Branch02=flatten(dfdoashvac_2.df_objs),
    Branch03=flatten(bang_7.Branch3),
    FlattenInputs=True)  # -> flatten(Result)
toggle_4 = BooleanToggle(False)
dfheatcoolhvac_4 = DFHeatCoolHVAC(df_objs=simplify(graft(applyfacadepar.df_obj)), system_type=simplify(graft(heatcool_2)))  # -> report, flatten(df_objs); plug-in component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
clean_2 = CleanTree(RemoveNulls=True, RemoveInvalid=toggle_4, RemoveEmpty=toggle_4, Tree=entwine_6)
sort_6 = SortList(Keys=entwine_5, ValuesA=clean_2)  # -> Keys, ValuesA

# ----
# HVAC Aligning
entwine_7 = Entwine(
    Branch00=flatten(bang_2.Branch0),
    Branch01=flatten(bang_2.Branch1),
    Branch02=flatten(bang_2.Branch2),
    Branch03=flatten(bang_2.Branch3),
    FlattenInputs=True)  # -> flatten(Result)
panel_61 = Panel(bang_3.Branch1)
entwine_8 = Entwine(
    Branch00=flatten(dfallairhvac.df_objs),
    Branch01=flatten(dfheatcoolhvac.df_objs),
    Branch02=flatten(dfdoashvac.df_objs),
    Branch03=flatten(bang_6.Branch3),
    FlattenInputs=True)  # -> flatten(Result)
toggle_5 = BooleanToggle(False)
clean_3 = CleanTree(RemoveNulls=True, RemoveInvalid=toggle_5, RemoveEmpty=toggle_5, Tree=entwine_8)
sort_7 = SortList(Keys=entwine_7, ValuesA=clean_3)  # -> Keys, ValuesA

# ----
# MODELING
panel_62 = Panel(weeklyschedule.schedule)

# ----
# SCENARIO
# SELECTING
entwine_9 = Entwine(Branch00=sort_7.ValuesA, Branch01=dfheatcoolhvac_3.df_objs, Branch02=sort_6.ValuesA, FlattenInputs=True)
panel_63 = Panel("""{0;0}
{0;1}""")
item_43 = ListItem(List=panel_63, Index=item_25, Wrap=True)
branch_3 = TreeBranch(Tree=entwine_9, Path=item_43, MaintainPaths=True)

model = DFModel(buildings=flatten(branch_3), name=item_24)  # -> report, model; plug-in component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
vizall = DFVisualizeAll(df_objs=flatten(model.model))  # -> geo; plug-in component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

# ----
# Create Scenario
# file and URBANopt
# folder Generation
panel_64 = Panel("10")
togeojson = DFModelToGeoJSON(model=model.model, location=importloc, shade_dist=panel_64, network=roads.network, folder=path_4, write=data_3)  # -> report, geojson, net_json, hb_jsons, hb_models; plug-in component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
dispatch_5 = Dispatch(List=data_4, DispatchPattern=[True, False])  # -> ListA, ListB
runurbanopt = DFRunURBANopt(
    geojson=togeojson.geojson,
    epw_file=path_6,
    sim_par=simpar,
    mappers=add_ev_load.mapper,
    emiss_yr=panel_35,
    run=dispatch_5.ListA)  # -> out, scenario, osm, idf, sql, zsz, rdd, html; plug-in component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
runurbanopt_2 = DFRunURBANopt(
    geojson=togeojson.geojson,
    epw_file=path_6,
    sim_par=simpar,
    mappers=add_ev_load.mapper,
    emiss_yr=panel_35,
    run=dispatch_5.ListB)  # -> out, scenario, osm, idf, sql, zsz, rdd, html; plug-in component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

path01 = FilePath(togeojson.geojson)
path02 = FilePath(runurbanopt_2.scenario)
colibri_out = ColibriOutputs(Path01=flatten(path01), Path02=flatten(path02))
colibri_in = ColibriInputsIterator(Index=index, ignoreAllWarningMsg=True)  # -> U, IP, Index, V_N
ca = ColibriAggregator(Folder="c:\Colibri", Inputs=colibri_in.IP, Outputs=colibri_out, Write=Toggle(False), recordingMode=0)

# ----
# EUI
eui = HBEndUseIntensity(sql=runurbanopt.sql)  # -> eui, eui_end_use, end_uses, gross_floor; plug-in component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
panel_65 = Panel(eui.eui)
panel_66 = Panel(eui.eui_end_use)
panel_67 = Panel(eui.end_uses)
roomenergyresult = HBReadRoomEnergyResult(sql=runurbanopt.sql)  # -> cooling, heating, lighting, electric_equip, gas_equip, process, hot_water, fan_electric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; plug-in component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

# ----
# Overview for Simulation Results
# Energy Use Intensity (EUI) in kWh/m^2
total_eui = Panel(eui.eui)

# ----
# CARBON
panel_68 = Panel("Future_Hourly_Electricity_Emissions")
importloc_2 = LBImportLocation(epw_file=path_6)  # -> location; plug-in component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
cei = HBCarbonEmissionIntensity(sql=runurbanopt.sql, loc_kgMWh=importloc_2)  # -> cei, cei_end_use, end_uses, gross_floor; plug-in component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
customresult = HBReadCustomResult(sql=runurbanopt.sql, output_names=panel_68)  # -> results; plug-in component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
dispatch_6 = Dispatch(List=customresult, DispatchPattern=electricity_emission_heat_map)  # -> ListA, ListB
panel_69 = Panel(cei.cei)
panel_70 = Panel(cei.cei_end_use)
massarithop = LBMassArithmeticOperation(data=flatten(dispatch_6.ListA))  # -> data; plug-in component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
panel_71 = Panel(cei.end_uses)
legendpar_2 = LBLegendParameters(num_decimals="5")  # -> leg_par; plug-in component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
hourlyplot_3 = LBHourlyPlot(data=massarithop, legend_par=legendpar_2)  # -> report, mesh, legend, borders, labels, title, vis_set; plug-in component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

# ----
# Carbon Emission Intensity (CEI) in kg CO2/m^2
category_2 = Panel(cei.cei_end_use)

merge_8 = Merge(
    Data1=roomenergyresult.cooling,
    Data2=roomenergyresult.heating,
    Data3=roomenergyresult.lighting,
    Data4=roomenergyresult.electric_equip,
    Data5=roomenergyresult.gas_equip,
    Data6=roomenergyresult.process,
    Data7=roomenergyresult.hot_water,
    Data8=roomenergyresult.fan_electric,
    Data9=roomenergyresult.pump_electric,
    Data10=roomenergyresult.people_gain,
    Data11=roomenergyresult.solar_gain,
    Data12=roomenergyresult.infiltration_load)
massarithop_2 = LBMassArithmeticOperation(data=merge_8)  # -> data; plug-in component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
massarithop_3 = LBMassArithmeticOperation(data=flatten(massarithop_2))  # -> data; plug-in component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
lng_19 = ListLength(List=vizfloors)
dispatch_7 = Dispatch(List=massarithop_2, DispatchPattern=color_mapping_for_eui)  # -> ListA, ListB
data_46 = Data(list_5)
panel_72 = Panel(lng_19)
analysisperiod = LBAnalysisPeriod(start_month=data_46, start_day=1, start_hour=0, end_month=data_46)  # -> period, hoys, dates; plug-in component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
colorrooms = HBColorRooms(data=flatten(dispatch_7.ListA), rooms_model=flatten(model.model), norm_by_flr=Toggle(True))  # -> report, mesh, wire_frame, legend, title, rooms, colors, values, vis_set; plug-in component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
arithop = LBArithmeticOperation(data_1=massarithop_3, data_2=panel_72, operator="/")  # -> data; plug-in component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
lng_20 = ListLength(List=analysisperiod.hoys)
division_6 = Division(A=lng_20, B=24)
series_18 = Series(Start=1, Step=1, Count=division_6)
analysisperiod_2 = LBAnalysisPeriod(start_month=data_46, start_day=series_18, start_hour=0, end_month=data_46, end_day=series_18)  # -> period, hoys, dates; plug-in component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
applyper = LBApplyAnalysisPeriod(data=arithop, period=analysisperiod_2.period)  # -> data; plug-in component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
massarithop_4 = LBMassArithmeticOperation(data=flatten(applyper))  # -> data; plug-in component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
arithop_2 = LBArithmeticOperation(data_1=massarithop_4, data_2=division_6, operator="/")  # -> data; plug-in component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
xdata = LBDeconstructData(data=arithop_2)  # -> header, values; plug-in component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
extremes_2 = MinMax(Number=xdata.values)  # -> Minimum, Maximum
panel_73 = Panel("""12 AM
1 AM
2 AM
3 AM
4 AM
5 AM
6 AM
7 AM
8 AM
9 AM
10 AM
11 AM
12 PM
1 PM
2 PM
3 PM
4 PM
5 PM
6 PM
7 PM
8 PM
9 PM
10 PM
11 PM""")
mindex_24 = MemberIndex(Set=xdata.values, Member=extremes_2.Maximum)  # -> Index, Count
item_44 = ListItem(List=panel_73, Index=mindex_24.Index, Wrap=True)

peak_hour = Panel(item_44)

loadbalance = HBThermalLoadBalance(
    rooms_model=flatten(model.model),
    cooling=roomenergyresult.cooling,
    heating=roomenergyresult.heating,
    lighting=roomenergyresult.lighting,
    electric_equip=roomenergyresult.electric_equip,
    gas_equip=roomenergyresult.gas_equip,
    process=roomenergyresult.process,
    hot_water=roomenergyresult.hot_water,
    people_gain=roomenergyresult.people_gain,
    solar_gain=roomenergyresult.solar_gain,
    infiltration_load=roomenergyresult.infiltration_load,
    mech_vent_load=roomenergyresult.mech_vent_load,
    nat_vent_load=roomenergyresult.nat_vent_load)  # -> report, balance, balance_stor, norm_bal, norm_bal_stor; plug-in component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
timeop = LBTimeIntervalOperation(data=loadbalance.balance)  # -> daily, monthly, mon_per_hr; plug-in component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
dispatch_8 = Dispatch(List=timeop.monthly, DispatchPattern=monthly_heat_balance)  # -> ListA, ListB
monthlychart = LBMonthlyChart(data=dispatch_8.ListA)  # -> out, data_mesh, data_lines, col_lines, legend, borders, labels, y_title, title, vis_set; plug-in component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

dispatch_9 = Dispatch(List=arithop, DispatchPattern=eui_heat_map)  # -> ListA, ListB
hourlyplot_4 = LBHourlyPlot(data=dispatch_9.ListA)  # -> report, mesh, legend, borders, labels, title, vis_set; plug-in component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
